# Dynamo graph CC_GMA2_Alternating Placement@Top_Cut_Bottom Level.dyn (Dynamo 2.3.0.5885)
# packages: CivilConnection2020 4.0.4, infranea 0.0.4, Dynamo@ROCO_Dyf 1.0.0, Clockwork for Dynamo 2.x 2.1.2, DynamoROCO 2.3.0.0

code_block = CodeBlock { "select below"; }
civilApplication = CivilConnection.CivilApplication.CivilApplication()
selectAlignmentByNameAndDrawing2 = Custom[SelectAlignmentByNameAndDrawing2](descritpionText=code_block, civilApp=civilApplication)  # package Dynamo@ROCO_Dyf
setStartEndEndstation = Custom[Alignment.SetStartEndEndstation](alignment=selectAlignmentByNameAndDrawing2.alignment)  # package infranea; Sets start and endstation of the alignment
code_block_2 = CodeBlock(startStation=setStartEndEndstation.startStation, endStation=setStartEndEndstation.endStation, alignment=setStartEndEndstation.alignment) { startStation[0]; endStation[0]; alignment; }

# group: Input
base_level_m = Levels("T.A.W.")  # graph input
n2nd_family_type = FamilyTypes("[Pr_20_85_62_14]_TBC Sheet pile AZ36-700N_(GMA2):TY_AZ36-700N")  # "2nd Family Type"; graph input
number_of_type_1_elements_in = DoubleSlider(1, range=1..20 step 1)  # "Number of Type 1 Elements in Sequence"; graph input
number_of_type_2_elements_in = DoubleSlider(1, range=1..20 step 1)  # "Number of Type 2 Elements in Sequence"; graph input
n1st_family_type = FamilyTypes("[Pr_20_85_62_10]_TBC Combi-Buispaal 1422-12_C9 Slot_ROCO_(GMA2):D*T - Lock_1422*12 - C9")  # "1st Family Type"; graph input
top_offset_m = DoubleInput(0.9)  # graph input
bottom_offset_m = DoubleInput(-39)  # graph input
cut_offset_m = DoubleInput(0.9)  # graph input
roco_pe_id_startid = DoubleInput(1)  # graph input
mirror_1st_family = BoolSelector(false)  # graph input
mirror_2nd_family = BoolSelector(false)  # graph input

# group: Input to Script Parameters
name = CivilConnection.Alignment.Name(alignment=code_block_2.alignment)
name_2 = CivilConnection.CivilDocument.Name(civilDocument=selectAlignmentByNameAndDrawing2.civilDocument)
code_block_3 = CodeBlock()
# ---------- code_block_3.designscript (6 lines) ----------
"\"CivilDocument.Name\": \"";
"\", \"Alignment.Name\": \"";
"\", \"Startstation\": ";
", \"Endstation\"";
", \"BaseLevel\"";
", \"Parameter for Pointdistance\" : \"Width\"";
# ----------------------------------------
startstation = CodeBlock(startStation=code_block_2.out0) { startStation; }
string_from_object = FromObject(obj=startstation)
endstation = CodeBlock(endStation=code_block_2.out1) { endStation; }
string_from_object_2 = FromObject(obj=endstation)
baselevel = Level.Elevation(level=base_level_m)
string_from_object_3 = FromObject(obj=baselevel)
parameter_for_pairdistance = CodeBlock { "ROCO_CLE_Length_Calc"; }

# group: C3DInfo for Component
code = CodeBlock(alignmentName=name) { out: string = alignmentName[0] +"|#"; }
name_3 = Watch(code)  # "ROCO.PM.Alignment.Name"
name_4 = Watch(name_2)  # "ROCO.PM.C3DDocument.Name"

# group: Converted Input
concat = String.Concat(string0=code_block_3.out0, string1=name_2, string2=code_block_3.out1, string3=name, string4=code_block_3.out2, string5=string_from_object, string6=code_block_3.out3, string7=string_from_object_2, string8=code_block_3.out4, string9=string_from_object_3, string10=code_block_3.out5, lacing=Longest)

# group: Get Elementwidth & Passtrough
getParameterValueByName = Element.GetParameterValueByName(element=n2nd_family_type, parameterName=parameter_for_pairdistance)
code_block_4 = CodeBlock(alignment=code_block_2.alignment, startstation=startstation, endstation=endstation, elevation=baselevel, type1Number=number_of_type_1_elements_in, type2Number=number_of_type_2_elements_in) { alignment; startstation; endstation; elevation; type1Number; type2Number; }
getParameterValueByName_2 = Element.GetParameterValueByName(element=n1st_family_type, parameterName=parameter_for_pairdistance)
code_block_5 = CodeBlock(alignment=code_block_4.alignment, startstation=code_block_4.startstation, endstation=code_block_4.endstation, elevation=code_block_4.elevation, type1Number=code_block_4.type1Number, type1Width=getParameterValueByName_2, type2Number=code_block_4.type2Number, type2Width=getParameterValueByName)
# ---------- code_block_5.designscript (12 lines) ----------
alignment;
startstation;
endstation;
elevation;
type1Number;
type1Width;
type1Gap = type1Width * type1Number;
0;
type2Number;
type2Width;
type2Gap = type2Width * type2Number;
startstation2 = startstation+ type1Gap;
# ----------------------------------------

watch = Watch(getParameterValueByName)
code_block_6 = CodeBlock { 0; }

# group: createStations
code_block_7 = CodeBlock(alignment=code_block_5.alignment, startstation=code_block_5.startstation, endstation=code_block_5.endstation, elevation=code_block_5.elevation, type1Number=code_block_5.type1Number, type1Width=code_block_5.type1Width, type2Number=code_block_5.type2Number, type2Width=code_block_5.type2Width)  # unwired: type1Mirror, type2Mirror
# ---------- code_block_7.designscript (14 lines) ----------
alignment;
startstation;
endstation;
elevation;
type1Number;
type1Width;
type1Gap = type1Width * type1Number;
0;
type2Number;
type2Width;
type2Gap = type2Width * type2Number;
startstation2 = startstation + type1Gap;
type1Mirror;
type2Mirror;
# ----------------------------------------
createStations3ByStartEndIntervalSpacing = Custom[CreateStations3ByStartEndIntervalSpacing](startStation=code_block_7.startstation2, endStation=code_block_7.endstation, interval=code_block_7.type2Width, spacing_m=code_block_7.type1Gap)  # creates stationlist based on start, end, interval and spacing. (spacing can be zero or Null
code_block_8 = CodeBlock { ["startStation","endStation"]; ["endStation","startStation"]; "midStation"; "index"; }
midstations_dictionary = DesignScript.Builtin.Dictionary.ValueAtKey(dictionary=createStations3ByStartEndIntervalSpacing, key=code_block_8.out2, lacing=CrossProduct)
createStations3ByStartEndIntervalSpacing_2 = Custom[CreateStations3ByStartEndIntervalSpacing](startStation=code_block_7.startstation, endStation=code_block_7.endstation, interval=code_block_7.type1Width, spacing_m=code_block_7.type2Gap)
code_block_9 = CodeBlock { ["startStation","endStation"]; ["endStation","startStation"]; "midStation"; "index"; }
mirroredorder_dictionary = DesignScript.Builtin.Dictionary.ValueAtKey(dictionary=createStations3ByStartEndIntervalSpacing_2, key=code_block_9.out1, lacing=CrossProduct)
regularorder_dictionary = DesignScript.Builtin.Dictionary.ValueAtKey(dictionary=createStations3ByStartEndIntervalSpacing_2, key=code_block_9.out0, lacing=CrossProduct)
if_ = If(test=code_block_7.type1Mirror, true=mirroredorder_dictionary, false=regularorder_dictionary)
mirroredorder_dictionary_2 = DesignScript.Builtin.Dictionary.ValueAtKey(dictionary=createStations3ByStartEndIntervalSpacing, key=code_block_8.out1, lacing=CrossProduct)
regularorder_dictionary_2 = DesignScript.Builtin.Dictionary.ValueAtKey(dictionary=createStations3ByStartEndIntervalSpacing, key=code_block_8.out0, lacing=CrossProduct)
if_2 = If(test=code_block_7.type2Mirror, true=mirroredorder_dictionary_2, false=regularorder_dictionary_2)
midstations_dictionary_2 = DesignScript.Builtin.Dictionary.ValueAtKey(dictionary=createStations3ByStartEndIntervalSpacing_2, key=code_block_9.out2, lacing=CrossProduct)
index_dictionary_valueatkey = DesignScript.Builtin.Dictionary.ValueAtKey(dictionary=createStations3ByStartEndIntervalSpacing_2, key=code_block_9.out3, lacing=CrossProduct)
index_dictionary_valueatkey_2 = DesignScript.Builtin.Dictionary.ValueAtKey(dictionary=createStations3ByStartEndIntervalSpacing, key=code_block_8.out3, lacing=CrossProduct)
code_block_10 = CodeBlock(alignment=code_block_7.alignment, type1PosStations=if_, type2PosStations=if_2, type1MidStations=midstations_dictionary_2, type2MidStation=mirroredorder_dictionary_2, elevations=code_block_7.elevation, index1=index_dictionary_valueatkey, index2=index_dictionary_valueatkey_2) { alignment; type1PosStations; type2PosStations; type1MidStations; type2MidStation; elevations; index1; index2; }

code_block_11 = CodeBlock { null; }

# group: Create Positions for type1
code_block_12 = CodeBlock(alignment=code_block_10.alignment, type1PosStations=code_block_10.type1PosStations, type1MidStations=code_block_10.type1MidStations, elevations=code_block_10.elevations, index1=code_block_10.index1) { alignment; type1PosStations; type1MidStations; elevations; index1; }
code_block_13 = CodeBlock { 0; }
type1points_alignment = CivilConnection.Alignment.PointByStationOffsetElevation(alignment=code_block_12.alignment, station=code_block_12.type1PosStations, offset=code_block_13, elevation=code_block_12.elevations, lacing=CrossProduct)
X = Point.X(point=type1points_alignment)
surveyPoint = Coordinates.SurveyPoint()
X_2 = Point.X(point=surveyPoint)
add = X + X_2
Y = Point.Y(point=type1points_alignment)
Y_2 = Point.Y(point=surveyPoint)
add_2 = Y + Y_2
Z = Point.Z(point=type1points_alignment)
byCoordinates = Point.ByCoordinates(x=add, y=add_2, z=Z)
code_block_14 = CodeBlock(type1Positions=byCoordinates, type1MidStations=code_block_12.type1MidStations, index=code_block_12.index1) { type1Positions; type1MidStations; index; }

# group: Create Positions for type2
code_block_15 = CodeBlock(alignment=code_block_10.alignment, type2PosStations=code_block_10.type2PosStations, type2MidStations=code_block_10.type2MidStation, elevations=code_block_10.elevations, index2=code_block_10.index2) { alignment; type2PosStations; type2MidStations; elevations; index2; }
code_block_16 = CodeBlock { 0; }
type2points_alignment = CivilConnection.Alignment.PointByStationOffsetElevation(alignment=code_block_15.alignment, station=code_block_15.type2PosStations, offset=code_block_16, elevation=code_block_15.elevations, lacing=CrossProduct)
X_3 = Point.X(point=type2points_alignment)
surveyPoint_2 = Coordinates.SurveyPoint()
X_4 = Point.X(point=surveyPoint_2)
add_3 = X_3 + X_4
Y_3 = Point.Y(point=type2points_alignment)
Y_4 = Point.Y(point=surveyPoint_2)
add_4 = Y_3 + Y_4
Z_2 = Point.Z(point=type2points_alignment)
byCoordinates_2 = Point.ByCoordinates(x=add_3, y=add_4, z=Z_2)
code_block_17 = CodeBlock(type2Positions=byCoordinates_2, type2MidStations=code_block_15.type2MidStations, index=code_block_15.index2) { type2Positions; type2MidStations; index; }

code_block_18 = CodeBlock()
# ---------- code_block_18.designscript (12 lines) ----------
["ROCO_CTE_OBS.Code",
"ROCO_CTE_OBS.Description",
"ROCO_CTE_Classification.Uniclass.Co.Code",
"ROCO_CTE_Classification.Uniclass.Co.Description",
"ROCO_CTE_Classification.Uniclass.EF.Code",
"ROCO_CTE_Classification.Uniclass.EF.Description",
"ROCO_CTE_Classification.Uniclass.En.Code",
"ROCO_CTE_Classification.Uniclass.En.Description",
"ROCO_CTE_Classification.Uniclass.SL.Code",
"ROCO_CTE_Classification.Uniclass.SL.Description",
"ROCO_CTE_Classification.Uniclass.Ss.Code",
"ROCO_CTE_Classification.Uniclass.Ss.Description"];
# ----------------------------------------

# group: Classification Input
code_2 = StringInput("")  # "Classification.ROCO.OBS.Code"; graph input
description = StringInput("")  # "Classification.ROCO.OBS.Description"; graph input
code_3 = StringInput("")  # "Uniclass.ROCO.Co.Code"; graph input
description_2 = StringInput("")  # "Uniclass.ROCO.Co.Description"; graph input
code_4 = StringInput("EF_37_50")  # "Classification.Uniclass.EF.Code"; graph input
description_3 = StringInput("Tunnels")  # "Classification.Uniclass.EF.Description"; graph input
code_5 = StringInput("En_")  # "Classification.Uniclass.En.Code"; graph input
description_4 = StringInput("")  # "Classification.Uniclass.En.Description"; graph input
code_6 = StringInput("SL_")  # "Classification.Uniclass.SL.Code"; graph input
description_5 = StringInput("")  # "Classification.Uniclass.SL.Description"; graph input
code_7 = StringInput("Ss_")  # "Classification.Uniclass.Ss.Code"; graph input
description_6 = StringInput("")  # "Classification.Uniclass.Ss.Description"; graph input

list_create = List.Create(item0=code_2, item1=description, item2=code_3, item3=description_2, item4=code_4, item5=description_3, item6=code_5, item7=description_4, item8=code_6, item9=description_5, item10=code_7, item11=description_6)
byKeysValues = DesignScript.Builtin.Dictionary.ByKeysValues(keys=code_block_18, values=list_create)
code_block_19 = CodeBlock()
# ---------- code_block_19.designscript (3 lines) ----------
["ROCO_CLE_Base_Offset",
"ROCO_CLE_Top_Offset",
"ROCO_CLE_Cut_Offset"];
# ----------------------------------------
list_create_2 = List.Create(item0=bottom_offset_m, item1=top_offset_m, item2=cut_offset_m)
byKeysValues_2 = DesignScript.Builtin.Dictionary.ByKeysValues(keys=code_block_19, values=list_create_2)
code_block_20 = CodeBlock(familyTypes1=n1st_family_type, familyType2=n2nd_family_type, topOffset=top_offset_m, baseOffset=bottom_offset_m, cutOffset=cut_offset_m, indexStart=roco_pe_id_startid, mirror2ndFam=mirror_1st_family, mirror1stFam=mirror_2nd_family, classificationParameters=byKeysValues, geometryParameters=byKeysValues_2)
# ---------- code_block_20.designscript (10 lines) ----------
familyTypes1;
familyType2;
topOffset;
baseOffset;
cutOffset;
indexStart;
mirror2ndFam;
mirror1stFam;
classificationParameters;
geometryParameters;
# ----------------------------------------

# group: Creating reference info dict for objects
code_block_21 = CodeBlock { ["docName","aliName","StartStation","EndStation"]; }
code_block_22 = CodeBlock(civilDocumentName=name_2, alignmentName=name, startStation=startstation, endStation=endstation) { civilDocumentName; alignmentName; startStation; endStation; }
list_create_3 = List.Create(item0=code_block_22.civilDocumentName, item1=code_block_22.alignmentName, item2=code_block_22.startStation, item3=code_block_22.endStation)
flatten = List.Flatten(list=list_create_3)
# note: description
code_block_23 = CodeBlock { ["Source","Type","ObjectDOB"]; ["C3D","Corridor&Alignment"]; }
now = DateTime.Now()

byKeysValues_3 = DesignScript.Builtin.Dictionary.ByKeysValues(keys=code_block_21, values=flatten)

# group (continued): Creating reference info dict for objects
code_block_24 = CodeBlock(c3dInfoDict=byKeysValues_3) { c3dInfoDict; }

code_block_25 = CodeBlock { "No config file used"; }

# group: Create script meta data file
string = StringInput("ScriptName")
python_script = Python()  # unwired: IN[0]
# ---------- python_script.python (29 lines) ----------
# Importing Reference Modules
# CLR ( Common Language Runtime Module )
import clr
# Adding the DynamoRevitDS.dll module to work with the Dynamo API
clr.AddReference('DynamoRevitDS')
import Dynamo 

# access to the current Dynamo instance and workspace
dynamoRevit = Dynamo.Applications.DynamoRevit()
currentWorkspace = dynamoRevit.RevitDynamoModel.CurrentWorkspace

# Access current version of dynamo
version=dynamoRevit.RevitDynamoModel.Version

# checks version of dynamo and adjusts output according to version
if version.StartsWith("1."):
	
	# Gets file name which includes full path
	filename=currentWorkspace.FileName
	
	
	# Splits out file path to just file name
	OUT=filename

elif version.StartsWith("2."):
	OUT=currentWorkspace.Name

else:
	OUT="Not supported"
# ----------------------------------------
string_from_object_4 = FromObject(obj=python_script)
byKeysValues_4 = DesignScript.Builtin.Dictionary.ByKeysValues(keys=string, values=string_from_object_4)
string_2 = StringInput("username")
userName = Custom[System.UserName]()  # package Clockwork for Dynamo 2.x; Returns the user name of the person who is currently logged on to Windows on the machine the script is executed on.
setValueAtKeys = DesignScript.Builtin.Dictionary.SetValueAtKeys(dictionary=byKeysValues_4, keys=string_2, values=userName)
code_block_26 = CodeBlock(scriptMeta=setValueAtKeys) { scriptMeta; }

# group: creating parameter_value dict for all type objects, including the script info
code_block_27 = CodeBlock { ["ROCO_CTE_Dynamo.GUID","ROCO_CTE_Dynamo.Script"]; }
generateGuid = DynamoROCO.DesignLog.GenerateGuid()
string_3 = StringInput("ConfigFileMeta")
# note: description
code_block_28 = CodeBlock(c3DInfoDict=code_block_24, configFileMeta=code_block_25, scriptMeta=code_block_26) { c3DInfoDict; configFileMeta; scriptMeta; }
byKeysValues_5 = DesignScript.Builtin.Dictionary.ByKeysValues(keys=string_3, values=code_block_28.configFileMeta)
string_4 = StringInput("ScriptMeta")
setValueAtKeys_2 = DesignScript.Builtin.Dictionary.SetValueAtKeys(dictionary=byKeysValues_5, keys=string_4, values=code_block_28.scriptMeta)
stringifyJSON = Data.StringifyJSON(values=setValueAtKeys_2, lacing=Longest)
list_create_4 = List.Create(item0=generateGuid, item1=stringifyJSON)
string_5 = StringInput("ROCO_CTE_Reference_Source_Data")
code_block_29 = CodeBlock(C3D_Reference_Dict=code_block_28.c3DInfoDict) { C3D_Reference_Dict; }
stringifyJSON_2 = Data.StringifyJSON(values=code_block_29, lacing=Longest)
setValueAtKeys_3 = DesignScript.Builtin.Dictionary.SetValueAtKeys(keys=code_block_27, values=list_create_4)  # unwired: dictionary

byKeysValues_6 = DesignScript.Builtin.Dictionary.ByKeysValues(keys=code_block_27, values=list_create_4)

# group (continued): creating parameter_value dict for all type objects, including the script info
setValueAtKeys_4 = DesignScript.Builtin.Dictionary.SetValueAtKeys(dictionary=byKeysValues_6, keys=string_5, values=stringifyJSON_2)
code_block_30 = CodeBlock(DynamoParameterDict=setValueAtKeys_4) { DynamoParameterDict; }

code_block_31 = CodeBlock(familyTypes1=code_block_20.familyTypes1, familyType2=code_block_20.familyType2, topOffset=code_block_20.topOffset, baseOffset=code_block_20.baseOffset, cutOffset=code_block_20.cutOffset, indexStart=code_block_20.indexStart, mirror2ndFam=code_block_20.mirror2ndFam, mirror1stFam=code_block_20.mirror1stFam, classificationDict=code_block_20.classificationParameters, geometryParameters=code_block_20.geometryParameters, DynamoParameterDict=code_block_30)
# ---------- code_block_31.designscript (11 lines) ----------
familyTypes1;
familyType2;
topOffset;
baseOffset;
cutOffset;
indexStart;
mirror2ndFam;
mirror1stFam;
classificationDict;
geometryParameters;
DynamoParameterDict;
# ----------------------------------------

# group: Create family instances
code_block_32 = CodeBlock(type1Positions=code_block_14.type1Positions, type2Positions=code_block_17.type2Positions, familyType1=code_block_31.familyTypes1, familyType2=code_block_31.familyType2) { type1Positions; type2Positions; familyType1; familyType2; }
byPoints = AdaptiveComponent.ByPoints(points=code_block_14.type1Positions, familyType=code_block_31.familyTypes1)
byPoints_2 = AdaptiveComponent.ByPoints(points=code_block_17.type2Positions, familyType=code_block_31.familyType2)

watch_2 = Watch(code_block_7.startstation2)
watch_3 = Watch(code_block_7.endstation)
string_from_object_5 = FromObject(obj=now)

# group (continued): Creating reference info dict for objects
addItemToEnd = List.AddItemToEnd(item=string_from_object_5, list=code_block_23.out1)
byKeysValues_7 = DesignScript.Builtin.Dictionary.ByKeysValues(keys=code_block_23.out0, values=addItemToEnd)
code_block_33 = CodeBlock(keys=code_block_21, values=flatten, main_dict=byKeysValues_7) { keys; values; main_dict; }

# group: CreateParameterValues1
code_block_34 = CodeBlock { "ROCO_CNU_OBS.Index"; "ROCO_CNU_Station"; }
code_block_35 = CodeBlock(index1=code_block_14.index, indexstart=code_block_31.indexStart, type1MidStations=code_block_14.type1MidStations, ClassificationDict=code_block_31.classificationDict, geometryParameters=code_block_31.geometryParameters, DynamoParameterDict=code_block_31.DynamoParameterDict) { index1; indexstart; type1MidStations; ClassificationDict; geometryParameters; DynamoParameterDict; }
set1indexvalues = code_block_35.index1 + code_block_35.indexstart
parameterset1_dictionary = DesignScript.Builtin.Dictionary.ByKeysValues(keys=code_block_34.out0, values=set1indexvalues, lacing=CrossProduct)
setValueAtKeys_5 = DesignScript.Builtin.Dictionary.SetValueAtKeys(dictionary=parameterset1_dictionary, keys=code_block_34.out1, values=code_block_35.type1MidStations, lacing=Longest)
keys = DesignScript.Builtin.Dictionary.Keys(dictionary=code_block_35.ClassificationDict)
valueAtKey = DesignScript.Builtin.Dictionary.ValueAtKey(dictionary=code_block_35.ClassificationDict, key=keys)
setValueAtKeys_6 = DesignScript.Builtin.Dictionary.SetValueAtKeys(dictionary=setValueAtKeys_5, keys=keys, values=valueAtKey)
keys_2 = DesignScript.Builtin.Dictionary.Keys(dictionary=code_block_35.geometryParameters)
valueAtKey_2 = DesignScript.Builtin.Dictionary.ValueAtKey(dictionary=code_block_35.geometryParameters, key=keys_2)
setValueAtKeys_7 = DesignScript.Builtin.Dictionary.SetValueAtKeys(dictionary=setValueAtKeys_6, keys=keys_2, values=valueAtKey_2)
keys_3 = DesignScript.Builtin.Dictionary.Keys(dictionary=code_block_35.DynamoParameterDict)
valueAtKey_3 = DesignScript.Builtin.Dictionary.ValueAtKey(dictionary=code_block_35.DynamoParameterDict, key=keys_3)
setValueAtKeys_8 = DesignScript.Builtin.Dictionary.SetValueAtKeys(dictionary=setValueAtKeys_7, keys=keys_3, values=valueAtKey_3)

# group: Set Type1Parameters
code_block_36 = CodeBlock(parameterDict=setValueAtKeys_8, familyInstance=byPoints) { parameterDict; familyInstance; }
keys_4 = DesignScript.Builtin.Dictionary.Keys(dictionary=code_block_36.parameterDict)
flatten_2 = List.Flatten(list=keys_4)
uniqueItems = List.UniqueItems(list=flatten_2)
parameterByName = Parameter.ParameterByName(element=code_block_36.familyInstance, name=uniqueItems, lacing=CrossProduct)
code_block_37 = CodeBlock { 1; }
flatten_3 = List.Flatten(list=parameterByName, amt=code_block_37)
valueAtKey_4 = DesignScript.Builtin.Dictionary.ValueAtKey(dictionary=code_block_36.parameterDict, key=keys_4)
transpose = List.Transpose(lists=valueAtKey_4)
setValue = Parameter.SetValue(parameter=flatten_3, value=transpose)

# group: CreateParameterValues2
code_block_38 = CodeBlock { "ROCO_CNU_OBS.Index"; "ROCO_CNU_Station"; }
code_block_39 = CodeBlock(index2=code_block_17.index, indexstart=code_block_31.indexStart, type2MidStations=code_block_17.type2MidStations, ClassificationDict=code_block_31.classificationDict, geometryParameters=code_block_31.geometryParameters, DynamoParameterDict=code_block_31.DynamoParameterDict) { index2; indexstart; type2MidStations; ClassificationDict; geometryParameters; DynamoParameterDict; }
set1indexvalues_2 = code_block_39.index2 + code_block_39.indexstart
parameterset1_dictionary_2 = DesignScript.Builtin.Dictionary.ByKeysValues(keys=code_block_38.out0, values=set1indexvalues_2, lacing=CrossProduct)
setValueAtKeys_9 = DesignScript.Builtin.Dictionary.SetValueAtKeys(dictionary=parameterset1_dictionary_2, keys=code_block_38.out1, values=code_block_39.type2MidStations, lacing=Longest)
keys_5 = DesignScript.Builtin.Dictionary.Keys(dictionary=code_block_39.ClassificationDict)
valueAtKey_5 = DesignScript.Builtin.Dictionary.ValueAtKey(dictionary=code_block_39.ClassificationDict, key=keys_5)
setValueAtKeys_10 = DesignScript.Builtin.Dictionary.SetValueAtKeys(dictionary=setValueAtKeys_9, keys=keys_5, values=valueAtKey_5)
keys_6 = DesignScript.Builtin.Dictionary.Keys(dictionary=code_block_39.geometryParameters)
valueAtKey_6 = DesignScript.Builtin.Dictionary.ValueAtKey(dictionary=code_block_39.geometryParameters, key=keys_6)
setValueAtKeys_11 = DesignScript.Builtin.Dictionary.SetValueAtKeys(dictionary=setValueAtKeys_10, keys=keys_6, values=valueAtKey_6)
keys_7 = DesignScript.Builtin.Dictionary.Keys(dictionary=code_block_39.DynamoParameterDict)
valueAtKey_7 = DesignScript.Builtin.Dictionary.ValueAtKey(dictionary=code_block_39.DynamoParameterDict, key=keys_7)
setValueAtKeys_12 = DesignScript.Builtin.Dictionary.SetValueAtKeys(dictionary=setValueAtKeys_11, keys=keys_7, values=valueAtKey_7)

# group: Set Type1Parameters
code_block_40 = CodeBlock(parameterDict=setValueAtKeys_12, familyInstance=byPoints_2) { parameterDict; familyInstance; }
keys_8 = DesignScript.Builtin.Dictionary.Keys(dictionary=code_block_40.parameterDict)
flatten_4 = List.Flatten(list=keys_8)
uniqueItems_2 = List.UniqueItems(list=flatten_4)
parameterByName_2 = Parameter.ParameterByName(element=code_block_40.familyInstance, name=uniqueItems_2, lacing=CrossProduct)
code_block_41 = CodeBlock { 1; }
flatten_5 = List.Flatten(list=parameterByName_2, amt=code_block_41)
valueAtKey_8 = DesignScript.Builtin.Dictionary.ValueAtKey(dictionary=code_block_40.parameterDict, key=keys_8)
transpose_2 = List.Transpose(lists=valueAtKey_8)
setValue_2 = Parameter.SetValue(parameter=flatten_5, value=transpose_2)
