# Dynamo graph CC_GMA2_GMA4_createObjects_wo_dimensions@CorridorFLpoints.dyn (Dynamo 2.3.0.5885)
# packages: Data-Shapes 2019.2.40, archi-lab.net 2020.22.9, Clockwork for Dynamo 2.x 2.1.2, DynamoROCO 2.3.0.0, CivilConnection2020 4.0.4, ROCO Dyf Packages 1.0.0

# group: DATA MANIPULATION
# note: Data manipulation on Dynamo Objects

# group: NOT IN USE
# note: Nodes to consider part of the final graph

# group: INPUT
# note: Data input and preperation for other nodes

# group: GET
# note: Get parameter values from Revit objects

# group: DEBUG
# note: Check if the graph is working as expected

# group: Package
# note: All used nodes from a package have a prefix
# added to them with the name of the node.

# group: FUNCTION
# note: Creation of dynamo objects

# group: OUTPUT
# note: Object creation in Revit, final output

# group: SET
# note: Set parameters on Revit objects

# group: INFO
# note: GENERAL INFO
# Version: 4
# Author: Dick Elsman
# Company: Infranea | ROCO
# email: dick.elsman@infranea.com
# Dynamo Core version: 2.3.0.5885
# Dynamo Revit version: 2.3.0.6270
# Revit version: 2020.2
# note: INSTRUCTIONS
# <DESCRIPTION>
# Allows the user to place GMA2  and GMA4 objects on featureline points pairs in the direction of the alignment (and corridor).  Duration of scripts depends on complexity of corridor and to be placed objects. Min runtime is about 5 minutes
# <INSTRUCTIONS>
# navigate to the folder to play, and press play in the Dynamo Player.
# NB! This script requires a JSON config file for it to index objects and data from sources. This/these file(s) shoudl be stored in <script directory>\config_files
# note: KNOWN ISSUES AND LIMITATIONS
# - Only runs with one CivilApplication open
# - Only use 1 region and baseline on your corridor
# - does not run properly if the families are not loaded
# note: SCRIPT META
# Script Name: CC_GMA2_GMA4_createObjects@CorridorFLpoints.dyn
# Packages used in this script:
# Data-Shapes version: 2019.2.40
# Clockwork for Dynamo 2.x version: 2.1.2
# DynamoROCO version: 2.3.0.0
# ROCO Dyf Packages version: 1.0.0
# TimeStamp : 2020/2/6 17:58

# group: Importing civil documents from application and fomratting for selecting corridor and FPcodes in UI
string = StringInput("Select only 1 FL point code below!")
# note: description
civilApplication_GetFLPCodesAsString = Custom[civilApplication_GetFLPCodesAsString]()  # package ROCO Dyf Packages; gets corridor names form all open CivilDocuments, outputting it in list with format "Doc | Corridor | FLPointsCodes"
code_block = CodeBlock { false; 75; }
ui_treeview_input = Custom[UI.TreeView input](InputName=string, Data=civilApplication_GetFLPCodesAsString.flPointCodes, FirstItemIsTitle=code_block.out0, Height=code_block.out1)  # package Data-Shapes; Create a TreeView input for UI.MultipleInputForm ++ . Check out www.data-shapes.net for more infos and tips!
code_block_2 = CodeBlock(UIobject=ui_treeview_input, stringLength=civilApplication_GetFLPCodesAsString.stringLength, civilApplication=civilApplication_GetFLPCodesAsString.civilApplication, Separator=civilApplication_GetFLPCodesAsString.stringSeparator) { UIobject; stringLength; civilApplication; Separator; }

# group: User selects config file to run script with
readConfigFileDirectory = Custom[readConfigFileDirectory]()  # package ROCO Dyf Packages; Import config file names stored in workspace, output UI objects for Data-Shapes containing filenames
code_block_3 = CodeBlock(chars=readConfigFileDirectory.strLength) { chars; width = Math.Max(750, Math.Round(200*chars/25 + 0.5*chars)); }
data_shapes_ui_multipleinputform = Custom[Data-Shapes_UI.MultipleInputForm ++](Description_optional=readConfigFileDirectory.description, Logo_optional=readConfigFileDirectory.logo, ButtonText_optional=readConfigFileDirectory.buttonText, Inputs=readConfigFileDirectory.UIObjects, Toggle=readConfigFileDirectory.hasData, CancelButtonText_optional=readConfigFileDirectory.cancelButton, Width_optional=code_block_3.width)  # package Data-Shapes; Create a form with multiple inputs. see www.data-shapes.net for tutorials and infos!
code_block_4 = CodeBlock(x=data_shapes_ui_multipleinputform.User_Inputs) { selectedConfigFile=x[0]; }

# group: Import JSON file for script config
code_block_5 = CodeBlock(selectedConfigFile=code_block_4) { selectedConfigFile; }
code_block_6 = CodeBlock { 0; }
getItemAtIndex = List.GetItemAtIndex(list=code_block_5, index=code_block_6)
readText = FileSystem.ReadText(file=getItemAtIndex)
parseJSON = Data.ParseJSON(json=readText)
code_block_7 = CodeBlock { "scriptDataDict"; "imageDict"; "configData"; }
valueAtKey = DesignScript.Builtin.Dictionary.ValueAtKey(dictionary=parseJSON, key=code_block_7.out1)
valueAtKey_2 = DesignScript.Builtin.Dictionary.ValueAtKey(dictionary=parseJSON, key=code_block_7.out0)
valueAtKey_3 = DesignScript.Builtin.Dictionary.ValueAtKey(dictionary=parseJSON, key=code_block_7.out2)
code_block_8 = CodeBlock { "#adaptivePoints"; }
valueAtKey_4 = DesignScript.Builtin.Dictionary.ValueAtKey(dictionary=valueAtKey_3, key=code_block_8)
code_block_9 = CodeBlock(imageDict=valueAtKey, scriptSettingsDict=valueAtKey_2, amountAdaptivePoints=valueAtKey_4, configFileMeta=valueAtKey_3) { imageDict; scriptSettingsDict; amountAdaptivePoints; configFileMeta; }

# group: Building dictionary for use in UI
# note: building UI data to feed the listview for selecting type objects
code_block_10 = CodeBlock(scriptDataDict=code_block_9.scriptSettingsDict) { scriptDataDict; }
keys = DesignScript.Builtin.Dictionary.Keys(dictionary=code_block_10)
toNumber = String.ToNumber(str=keys)
sortListByAnother = archilab.Lists.Lists.SortListByAnother(list=keys, sortBy=toNumber)
string_2 = StringInput(" : ")
operators = sortListByAnother.list + string_2
valueAtKey_5 = DesignScript.Builtin.Dictionary.ValueAtKey(dictionary=code_block_10, key=sortListByAnother.list)
string_3 = StringInput("name")
valueAtKey_6 = DesignScript.Builtin.Dictionary.ValueAtKey(dictionary=valueAtKey_5, key=string_3)
operators_2 = operators + valueAtKey_6
code_block_11 = CodeBlock(listviewDisplayData=operators_2, sorted_dict_keys=sortListByAnother.list) { item_index_values; listviewDisplayData; sorted_dict_keys; }  # unwired: item_index_values

# group: Creating image data for use in script
# note: Converting the imported json into 2 filepath, 1 for the logo in the UI, the other as reference image in the UI
code_block_12 = CodeBlock(JSONImportPictureData=code_block_9.imageDict) { JSONImportPictureData; }
code_block_13 = CodeBlock { "Logo"; "ReferenceImage"; }
valueAtKey_7 = DesignScript.Builtin.Dictionary.ValueAtKey(dictionary=code_block_12, key=code_block_13.out0)
fromPath = FileObject(path=valueAtKey_7)  # "File.FromPath"
readFromFile = Image.ReadFromFile(file=fromPath)
code_block_14 = CodeBlock(Logo=readFromFile) { Logo; }
string_4 = StringInput("Reference image")
valueAtKey_8 = DesignScript.Builtin.Dictionary.ValueAtKey(dictionary=code_block_12, key=code_block_13.out1)
fromPath_2 = FileObject(path=valueAtKey_8)  # "File.FromPath"
string_from_object = FromObject(obj=fromPath_2)
filepath_from_string_python = Python(IN[0]=string_from_object)  # "filepath from string:python script"
# ---------- filepath_from_string_python.python (14 lines) ----------
# Load the Python Standard and DesignScript Libraries
import sys
import clr
import os
clr.AddReference('ProtoGeometry')
from Autodesk.DesignScript.Geometry import *

# The inputs to this node will be stored as a list in the IN variables.


# Place your code below this line

# Assign your outputto the OUT variable.
OUT = os.path.join(IN[0])
# ----------------------------------------
boolean = BoolSelector(false)
data_shapes_ui_image_data = Custom[Data-Shapes_UI.Image Data](Image=filepath_from_string_python, ShowBorder_optional=boolean)  # package Data-Shapes; Places an image on UI.MultipleInutForm ++ .
data_shapes_ui_inputgroup_data = Custom[Data-Shapes_UI.InputGroup Data](GroupTitle=string_4, Inputs=data_shapes_ui_image_data)  # package Data-Shapes; Creates a group of inputs for UI.MultipleInputForm ++ . Check out www.data-shapes.net for more infos !
code_block_15 = CodeBlock(LogoImage=code_block_14, referenceImageObject=data_shapes_ui_inputgroup_data) { LogoImage; referenceImageObject; }

code_block_16 = CodeBlock(imageDict=code_block_9.imageDict, scriptSettingsDict=code_block_9.scriptSettingsDict, amountAdaptivePoints=code_block_9.amountAdaptivePoints, configFileMeta=code_block_9.configFileMeta) { imageDict; scriptSettingsDict; amountAdaptivePoints; configFileMeta; }

# group: creating input values for selecting type objects
string_5 = StringInput("Select below which objects of the tunnel you want to place based on the alignments. Note: be sure you have loaded all the correct families in the project BEFORE continueing.")
# note: description
code_block_17 = CodeBlock(item_index_values=code_block_11.item_index_values, listviewDisplayData=code_block_11.listviewDisplayData, sorted_dict_keys=code_block_11.sorted_dict_keys, referenceImage=code_block_15.referenceImageObject, uiLogo=code_block_15.LogoImage, scriptSettingsDict=code_block_16.scriptSettingsDict) { item_index_values; listviewDisplayData; sorted_dict_keys; referenceImage; uiLogo; scriptSettingsDict; }
string_6 = StringInput("Continue")
string_7 = StringInput("Select which object to create in this script")
code_block_18 = CodeBlock { "Select which objects of the tunnel  sections you want to place"; }
code_block_19 = CodeBlock { false; }
data_shapes_ui_listview_data = Custom[Data-Shapes_UI.Listview Data](InputName=code_block_18, Keys=code_block_17.listviewDisplayData, Values=code_block_17.sorted_dict_keys, SortItems_optionnal=code_block_19)  # package Data-Shapes; Create data for ListView input in UI.MultiInputForm ++ . Check out www.data-shapes.net for more infos.
list_create = List.Create(item0=data_shapes_ui_listview_data)
data_shapes_ui_inputgroup_data_2 = Custom[Data-Shapes_UI.InputGroup Data](GroupTitle=string_7, Inputs=list_create)
list_create_2 = List.Create(item0=code_block_17.referenceImage, item1=data_shapes_ui_inputgroup_data_2)
boolean_2 = BoolSelector(true)
code_block_20 = CodeBlock { "Cancel"; 1000; }
code_block_21 = CodeBlock(Descritpion=string_5, logo=code_block_17.uiLogo, ButtonText=string_6, inputs=list_create_2, objectHasData=boolean_2, cancelButtonText=code_block_20.out0, maxHeight=code_block_20.out1, uiWidth=code_block_20.out1, scriptSettingsDict=code_block_17.scriptSettingsDict) { Descritpion; logo; ButtonText; inputs; objectHasData; cancelButtonText; maxHeight; uiWidth; scriptSettingsDict; }

# group: User selects type object to place with script
# note: User selects which objects to place
data_shapes_ui_multipleinputform_2 = Custom[Data-Shapes_UI.MultipleInputForm ++](Description_optional=code_block_21.Descritpion, Logo_optional=code_block_21.logo, ButtonText_optional=code_block_21.ButtonText, Inputs=code_block_21.inputs, Toggle=code_block_21.objectHasData, CancelButtonText_optional=code_block_21.cancelButtonText, MaxHeight_optional=code_block_21.maxHeight, Width_optional=code_block_21.uiWidth)
code_block_22 = CodeBlock { null; }
if_ = If(test=data_shapes_ui_multipleinputform_2.Was_Cancelled, true=code_block_22, false=data_shapes_ui_multipleinputform_2.User_Inputs)
code_block_23 = CodeBlock(selectedItems=if_) { selectedItems; }

# group: Filtering scritpDataDict based on selected items
# note: description
code_block_24 = CodeBlock(scritpDataDict=code_block_21.scriptSettingsDict, selectedItems=code_block_23) { scritpDataDict; selectedItems; }
flatten = List.Flatten(list=code_block_24.selectedItems)
designscriptbuiltin = DesignScript.Builtin.Dictionary.ValueAtKey(dictionary=code_block_24.scritpDataDict, key=flatten)
code_block_25 = CodeBlock(selectedDict=designscriptbuiltin) { selectedDict; }
string_8 = StringInput(" : ")
operators_3 = flatten + string_8
string_9 = StringInput("name")
designscriptbuiltin_2 = DesignScript.Builtin.Dictionary.ValueAtKey(dictionary=code_block_25, key=string_9)
operators_4 = operators_3 + designscriptbuiltin_2
code_block_26 = CodeBlock(selectedObjectDicts=code_block_25, selectedObjectTypeNames=operators_4) { selectedObjectDicts; selectedObjectTypeNames; }

# group: Filter families in project based on search query of config_file
code_block_27 = CodeBlock { "filters targetlist based on string: "; "'|' is used to define 'or'"; "',' is used to define 'and'"; }
# note: filter Family object items based on string
string_10 = StringInput("fam_search")
designscriptbuiltin_3 = DesignScript.Builtin.Dictionary.ValueAtKey(dictionary=code_block_26.selectedObjectDicts, key=string_10)
element_types = ElementTypes("Family")
all_elements_of_type = ElementsOfType(element_type=element_types)
name = Element.Name(element=all_elements_of_type)
boolean_3 = BoolSelector(true)
code_block_28 = CodeBlock(filters=designscriptbuiltin_3, targetList=name, ignoreCase=boolean_3) { filters; targetList; ignoreCase; }
list_Filterbystring = Custom[List_Filterbystring](TargetList=code_block_28.targetList, Filterlist=code_block_28.filters, ignorCase=code_block_28.ignoreCase)  # package ROCO Dyf Packages; Filters targetlist based on string: | is used to define 'or' , is used to define 'and'
code_block_29 = CodeBlock { "match"; }
valueAtKey_9 = DesignScript.Builtin.Dictionary.ValueAtKey(dictionary=list_Filterbystring, key=code_block_29)
familySelectionUIData_FromName = Custom[FamilySelectionUIData_FromName](familyName=valueAtKey_9)  # package ROCO Dyf Packages; Creates family ui data from Family Names

code_block_30 = CodeBlock(referenceImage=code_block_15.referenceImageObject, groupNames=code_block_26.selectedObjectTypeNames, Logo=code_block_15.LogoImage, civilApplication=code_block_2.civilApplication) { referenceImage; groupNames; Logo; civilApplication; }

# group: Creating UI objects for selecting family types and civil corridor FPCodes
code_block_31 = CodeBlock { "select famliy + type"; }
# note: description
code_block_32 = CodeBlock(uiObject=code_block_2.UIobject, stringLength=code_block_2.stringLength, familyTypes=familySelectionUIData_FromName.familyTypes, family_input_selection_string=familySelectionUIData_FromName.inputFamilyTypeString, logo=code_block_30.Logo, referenceImage=code_block_30.referenceImage, groupImages=code_block_30.groupNames) { uiObject; stringLength; familyTypes; family_input_selection_string; logo; referenceImage; groupImages; }
code_block_33 = CodeBlock { 0; }
data_shapes_ui_dropdown_data = Custom[Data-Shapes_UI.DropDown Data](InputName=code_block_31, Keys=code_block_32.family_input_selection_string, Values=code_block_32.familyTypes, DefaultValueIndex=code_block_33, lacing=Longest)  # package Data-Shapes; Create data for DropDown input in UI.MultiInputForm ++ . Check out www.data-shapes.net for more infos.
flatten_2 = List.Flatten(list=code_block_32.family_input_selection_string)
length = String.Length(str=flatten_2)
maximumItem = List.MaximumItem(list=length)
code_block_34 = CodeBlock(UIobject=data_shapes_ui_dropdown_data, stringLength=maximumItem) { UIobject; stringLength; }
clockwork_Passthrough = Custom[Clockwork_Passthrough](passThrough=code_block_34.UIobject, waitFor=code_block_32.uiObject)  # package Clockwork for Dynamo 2.x; Forces a sequential order of execution. The node wired into the output of the Passthrough node will be executed *after* the node wired into the waitFor input (e.g. important for some Revit operations). The value of the passThrough input will be passed on to the node wired into the output port of the Passthrough node.
clockwork_Passthrough_2 = Custom[Clockwork_Passthrough](passThrough=code_block_32.uiObject, waitFor=code_block_34.UIobject)
addItemToEnd = List.AddItemToEnd(item=clockwork_Passthrough_2)  # unwired: list
map = List.Map(list=clockwork_Passthrough, f_x=addItemToEnd)
python_script = Python(IN[0]=map)
# ---------- python_script.python (24 lines) ----------
# Load the Python Standard and DesignScript Libraries
import sys
import clr
clr.AddReference('ProtoGeometry')
from Autodesk.DesignScript.Geometry import *

# The inputs to this node will be stored as a list in the IN variables.
inlist=IN[0]
templist=[]
outlist=[]
# Place your code below this line
for sublist in inlist:
	templist.Clear()
	for item in sublist:
		if "list" in str(type(item)):
			for i in item:
				templist.append(i)
		else:
			templist.append(item)
	outlist.append(list(templist))
			
		
# Assign your output to the OUT variable.
OUT = outlist
# ----------------------------------------
string_11 = StringInput("Continue")
string_12 = StringInput("instructions:")
string_13 = StringInput("Select which familys and types match with the objects previously checked. Additionally select the corridor featurelinepoint on which the objects should be hosted. If the UI shows \"No family or type found\", it means that no family is loaded which matches the search query for the object. Make sure the names of the families are correct!")
data_shapes_ui_textnote_data = Custom[Data-Shapes_UI.TextNote Data](Title=string_12, TextNote=string_13)  # package Data-Shapes; Create Data for TextNote input in UI.MultipleInputForm ++ . Check out www.data-shapes.net for more informations
data_shapes_ui_inputgroup_data_3 = Custom[Data-Shapes_UI.InputGroup Data](GroupTitle=code_block_32.groupImages, Inputs=map)
addItemToFront = List.AddItemToFront(item=data_shapes_ui_textnote_data, list=data_shapes_ui_inputgroup_data_3)
addItemToFront_2 = List.AddItemToFront(item=code_block_32.referenceImage, list=addItemToFront)
isNull = Object.IsNull(obj=data_shapes_ui_inputgroup_data_3)
uniqueItems = List.UniqueItems(list=isNull)
operators_Not = Not(x=uniqueItems)
code_block_35 = CodeBlock { "Cancel"; 1000; }
max = Math.Max(value1=code_block_32.stringLength, value2=code_block_34.stringLength)
code_block_36 = CodeBlock(chars=max) { chars; width = Math.Max(750, Math.Round(200*chars/25 + 0.5*chars)); }
code_block_37 = CodeBlock(logo=code_block_32.logo, ButtonText=string_11, inputs=addItemToFront_2, objectHasData=operators_Not, cancelButtonText=code_block_35.out0, maxHeight=code_block_35.out1, uiWidth=code_block_36.width) { Descritpion; logo; ButtonText; inputs; objectHasData; cancelButtonText; maxHeight; uiWidth; }  # unwired: Descritpion

code_block_38 = CodeBlock(imageDict=code_block_16.imageDict, scriptSettingsDict=code_block_16.scriptSettingsDict, amountAdaptivePoints=code_block_16.amountAdaptivePoints, configFileMeta=code_block_16.configFileMeta) { imageDict; scriptSettingsDict; amountAdaptivePoints; configFileMeta; }

# group: User selects family types and FP codes
# note: description
data_shapes_ui_multipleinputform_3 = Custom[Data-Shapes_UI.MultipleInputForm ++](Description_optional=code_block_37.Descritpion, Logo_optional=code_block_37.logo, ButtonText_optional=code_block_37.ButtonText, Inputs=code_block_37.inputs, Toggle=code_block_37.objectHasData, CancelButtonText_optional=code_block_37.cancelButtonText, MaxHeight_optional=code_block_37.maxHeight, Width_optional=code_block_37.uiWidth)
code_block_39 = CodeBlock { null; }
if_2 = If(test=data_shapes_ui_multipleinputform_3.Was_Cancelled, true=code_block_39, false=data_shapes_ui_multipleinputform_3.User_Inputs)
code_block_40 = CodeBlock(selectedItems=if_2) { selectedItems; }

code_block_41 = CodeBlock(groupNames=code_block_30.groupNames, selectedFamilyTypesAndCivilData=code_block_40, stringSeperator=code_block_2.Separator, referenceImage=code_block_30.referenceImage, Logo=code_block_30.Logo, civilApplication=code_block_30.civilApplication) { groupNames; selectedFamilyTypesAndCivilData; stringSeperator; referenceImage; Logo; civilApplication; }

# group: creating data for table view based on selected family types and civil info
# note: description
code_block_42 = CodeBlock(groupNames=code_block_41.groupNames, selectedFamilyTypesAndCivilData=code_block_41.selectedFamilyTypesAndCivilData, stringSeperator=code_block_41.stringSeperator) { groupNames; selectedFamilyTypesAndCivilData; stringSeperator; }
UI_createTableData = Custom[UI_createTableData](groupNames=code_block_42.groupNames, dataSelection=code_block_42.selectedFamilyTypesAndCivilData, stringSeperator=code_block_42.stringSeperator)  # package ROCO Dyf Packages; create table data from nested list
code_block_43 = CodeBlock(tableTitle=UI_createTableData.tableTitle, tableData=UI_createTableData.tableData) { tableTitle; tableData; }

# group: creating input objects from formatted data
# note: description
code_block_44 = CodeBlock(tableTitle=code_block_43.tableTitle, tableData=code_block_43.tableData, referenceImage=code_block_41.referenceImage, logo=code_block_41.Logo) { tableTitle; tableData; referenceImage; logo; }
string_14 = StringInput("Continue")
string_15 = StringInput("Instructions")
string_16 = StringInput("Check if the data in the table is correct, before pressing \"continue\". DO NOT  change anything if you are not sure what to input. The script continues based on this data! put in N/A in a family name to remove it from the list to place.")
data_shapes_ui_textnote_data_2 = Custom[Data-Shapes_UI.TextNote Data](Title=string_15, TextNote=string_16)
code_block_45 = CodeBlock { ["Selected object","Family name", "Family type","Civil document", "Corridor name", "FL point code"]; }
transpose = List.Transpose(lists=code_block_44.tableData)
addItemToFront_3 = List.AddItemToFront(item=code_block_45, list=transpose)
code_block_46 = CodeBlock { true; }
data_shapes_ui_datatable_input = Custom[Data-Shapes_UI.DataTable input](InputName=code_block_44.tableTitle, Data=addItemToFront_3, FirstRowIsTitles=code_block_46)  # package Data-Shapes; Create a DataTable view input for UI.MultipleInputForm ++
data_shapes_ui_inputgroup_data_4 = Custom[Data-Shapes_UI.InputGroup Data](Inputs=data_shapes_ui_datatable_input)
addItemToFront_4 = List.AddItemToFront(item=data_shapes_ui_textnote_data_2, list=data_shapes_ui_inputgroup_data_4)
addItemToFront_5 = List.AddItemToFront(item=code_block_44.referenceImage, list=addItemToFront_4)
isNull_2 = Object.IsNull(obj=data_shapes_ui_datatable_input)
uniqueItems_2 = List.UniqueItems(list=isNull_2)
operators_Not_2 = Not(x=uniqueItems_2)
clockwork_Passthrough_3 = Custom[Clockwork_Passthrough](passThrough=addItemToFront_5, waitFor=operators_Not_2)
code_block_47 = CodeBlock { "Cancel"; 1200; }
code_block_48 = CodeBlock(logo=code_block_44.logo, ButtonText=string_14, inputs=clockwork_Passthrough_3, objectHasData=operators_Not_2, maxHeight=code_block_47.out1, uiWidth=code_block_47.out1, tableTitles=code_block_45) { Descritpion; logo; ButtonText; inputs; objectHasData; cancelButtonText; maxHeight; uiWidth; tableTitles; }  # unwired: Descritpion, cancelButtonText

# group: UI table summary view
# note: description
data_shapes_ui_multipleinputform_4 = Custom[Data-Shapes_UI.MultipleInputForm ++](Logo_optional=code_block_48.logo, ButtonText_optional=code_block_48.ButtonText, Inputs=code_block_48.inputs, Toggle=code_block_48.objectHasData, CancelButtonText_optional=code_block_48.cancelButtonText, MaxHeight_optional=code_block_48.maxHeight, Width_optional=code_block_48.uiWidth)
code_block_49 = CodeBlock { null; }
if_3 = If(test=data_shapes_ui_multipleinputform_4.Was_Cancelled, true=code_block_49, false=data_shapes_ui_multipleinputform_4.User_Inputs)
code_block_50 = CodeBlock(selectedValues=if_3) { selectedValues; }

# group: splitting table data and filtering out obsolete items
# note: description
code_block_51 = CodeBlock(tableHeaders=code_block_48.tableTitles, tableValues=code_block_50) { tableHeaders; tableValues; }
flatten_3 = List.Flatten(list=code_block_51.tableValues)
count = List.Count(list=code_block_51.tableHeaders)
chop = List.Chop(list=flatten_3, lengths=count)
code_block_52 = CodeBlock { 0; 1; 2; 3; 4; 5; }
removeItemAtIndex = List.RemoveItemAtIndex(list=chop, indices=code_block_52.out0)
objectnamegroup_list = List.GetItemAtIndex(list=removeItemAtIndex, index=code_block_52.out0, lacing=Longest)
familyname_list_getitematindex = List.GetItemAtIndex(list=removeItemAtIndex, index=code_block_52.out1, lacing=Longest)
toUpper = String.ToUpper(str=familyname_list_getitematindex)
code_block_53 = CodeBlock { "N/A"; }
operators_5 = toUpper != code_block_53
object_type_list = List.FilterByBoolMask(list=objectnamegroup_list, mask=operators_5)
family_name_list = List.FilterByBoolMask(list=familyname_list_getitematindex, mask=operators_5)
familytype_list_getitematindex = List.GetItemAtIndex(list=removeItemAtIndex, index=code_block_52.out2, lacing=Longest)
family_type_name_list = List.FilterByBoolMask(list=familytype_list_getitematindex, mask=operators_5)
civildocumentname_list = List.GetItemAtIndex(list=removeItemAtIndex, index=code_block_52.out3, lacing=Longest)
filterByBoolMask = List.FilterByBoolMask(list=civildocumentname_list, mask=operators_5)
corridorname_list_getitematindex = List.GetItemAtIndex(list=removeItemAtIndex, index=code_block_52.out4, lacing=Longest)
corridorname_list = List.FilterByBoolMask(list=corridorname_list_getitematindex, mask=operators_5)
flpointcode_list_getitematindex = List.GetItemAtIndex(list=removeItemAtIndex, index=code_block_52.out5, lacing=Longest)
flpointcode_list = List.FilterByBoolMask(list=flpointcode_list_getitematindex, mask=operators_5)
list_create_3 = List.Create(item0=object_type_list.in, item1=family_name_list.in, item2=family_type_name_list.in, item3=filterByBoolMask.in, item4=corridorname_list.in, item5=flpointcode_list.in)
code_block_54 = CodeBlock(filteredTableContent=list_create_3, objectTypes=object_type_list.in, familyNames=family_name_list.in, familyTypeNames=family_type_name_list.in, civilDocumentName=filterByBoolMask.in, corridorName=corridorname_list.in, FlpointCode=flpointcode_list.in) { filteredTableContent; objectTypes; familyNames; familyTypeNames; civilDocumentName; corridorName; FlpointCode; }

# group: Obtaining type ID's to filter settings dictionary
# note: description
code_block_55 = CodeBlock(objectNames=code_block_54.objectTypes) { objectNames; }
string_17 = StringInput(" : ")
split = String.Split(str=code_block_55, separator0=string_17)
code_block_56 = CodeBlock { 0; }
getItemAtIndex_2 = List.GetItemAtIndex(index=code_block_56)  # unwired: list
map_2 = List.Map(list=split, f_x=getItemAtIndex_2)
code_block_57 = CodeBlock(selectedObjectKeys=map_2) { selectedObjectKeys; }

# group: Creating reference info dict for objects
# note: description
code_block_58 = CodeBlock(civilDocumentName=code_block_54.civilDocumentName, corridorName=code_block_54.corridorName, flPointCode=code_block_54.FlpointCode) { civilDocumentName; corridorName; flPointCode; }
C3DMeta_CorridorFLPoints = Custom[C3DMeta_CorridorFLPoints](civilDocumentName=code_block_58.civilDocumentName, corridorName=code_block_58.corridorName, flPointCode=code_block_58.flPointCode)  # package ROCO Dyf Packages; create metadata script for corridorflPoint scripts
code_block_59 = CodeBlock(c3dInfoDict=C3DMeta_CorridorFLPoints) { c3dInfoDict; }

# group: creating diverse dicts to continue script
# note: description
code_block_60 = CodeBlock(settingsDict=code_block_38.scriptSettingsDict, selectedObjectKeys=code_block_57, c3dInfo=code_block_59) { settingsDict; selectedObjectKeys; c3dInfo; }
flatten_4 = List.Flatten(list=code_block_60.selectedObjectKeys)
designscriptbuiltin_4 = DesignScript.Builtin.Dictionary.ValueAtKey(dictionary=code_block_60.settingsDict, key=flatten_4)
byKeysValues = DesignScript.Builtin.Dictionary.ByKeysValues(keys=flatten_4, values=designscriptbuiltin_4)
string_18 = StringInput("defaultParameters")
designscriptbuiltin_5 = DesignScript.Builtin.Dictionary.ValueAtKey(dictionary=designscriptbuiltin_4, key=string_18)
string_19 = StringInput(" : ")
operators_6 = flatten_4 + string_19
string_20 = StringInput("name")
designscriptbuiltin_6 = DesignScript.Builtin.Dictionary.ValueAtKey(dictionary=designscriptbuiltin_4, key=string_20)
operators_7 = operators_6 + designscriptbuiltin_6
string_21 = StringInput("numberParams")
designscriptbuiltin_list_of = DesignScript.Builtin.Dictionary.ValueAtKey(dictionary=designscriptbuiltin_4, key=string_21)
string_22 = StringInput("C3D info")
setValueAtKeys = DesignScript.Builtin.Dictionary.SetValueAtKeys(dictionary=designscriptbuiltin_4, keys=string_22, values=code_block_60.c3dInfo, lacing=Longest)
code_block_61 = CodeBlock { ["fam_search","defaultParameters","numberParams"]; }
designscriptbuiltin_prepare_dict = DesignScript.Builtin.Dictionary.RemoveKeys(dictionary=setValueAtKeys, keys=code_block_61)
code_block_62 = CodeBlock(defaultParameterList=designscriptbuiltin_5, selectedItemNames=operators_7, numberParameterNames=designscriptbuiltin_list_of, scriptSettings=designscriptbuiltin_prepare_dict) { defaultParameterList; selectedItemNames; numberParameterNames; scriptSettings; }

# group: get corridor featurelinepoints
# note: Get Featureline points
code_block_63 = CodeBlock(civilApplication=code_block_41.civilApplication, documentNames=code_block_54.civilDocumentName, corridorNames=code_block_54.corridorName, FlpointCodes=code_block_54.FlpointCode) { civilApplication; documentNames; corridorNames; FlpointCodes; }
getDocumentByName = CivilConnection.CivilApplication.GetDocumentByName(civilApplication=code_block_63.civilApplication, name=code_block_63.documentNames)
getCorridorByName = CivilConnection.CivilDocument.GetCorridorByName(civilDocument=getDocumentByName, name=code_block_63.corridorNames)
baselines = CivilConnection.Corridor.Baselines(corridor=getCorridorByName)
flatten_5 = List.Flatten(list=baselines)
getBaselineRegions = CivilConnection.Baseline.GetBaselineRegions(baseline=flatten_5)
stations = CivilConnection.BaselineRegion.Stations(baselineRegion=getBaselineRegions)
getFeaturelinePointsByCode = CivilConnection.Baseline.GetFeaturelinePointsByCode(baseline=flatten_5, code=code_block_63.FlpointCodes)
code_block_64 = CodeBlock(baselineStations=stations, baseline_fl_points=getFeaturelinePointsByCode, corridor=getCorridorByName) { baselineStations; baseline_fl_points; corridor; }
move_last_dimension_in_list_up_1 = Python()  # "Move last dimension in list up 1 (flatten-1):Python Script"; unwired: IN[0]
# ---------- move_last_dimension_in_list_up_1.python (21 lines) ----------
# Load the Python Standard and DesignScript Libraries
import sys
import clr
clr.AddReference('ProtoGeometry')
from Autodesk.DesignScript.Geometry import *

# The inputs to this node will be stored as a list in the IN variables.
inlist=IN[0]
templist=[]
outlist=[]
# Place your code below this line
for sublist in inlist:
	templist.Clear()
	for item in sublist:
		for i in item:
			templist.append(i)
	outlist.append(list(templist))
			
		
# Assign your output to the OUT variable.
OUT = outlist
# ----------------------------------------

# group: get directional flPoints for each baseline
code_block_65 = CodeBlock(baseline=flatten_5) { baseline; }
code_block_66 = CodeBlock { ["LEFT_OF_AXIS","RIGHT_OF_AXIS","ORIGIN"]; }
getFeaturelinePointsByCode_2 = CivilConnection.Baseline.GetFeaturelinePointsByCode(code=code_block_66, lacing=Longest)  # unwired: baseline
map_3 = List.Map(list=code_block_65, f_x=getFeaturelinePointsByCode_2)
code_block_67 = CodeBlock { 0; 1; 2; }
left_list_getitematindex = List.GetItemAtIndex(list=map_3, index=code_block_67.out0, lacing=CrossProduct)
right_list_getitematindex = List.GetItemAtIndex(list=map_3, index=code_block_67.out1, lacing=CrossProduct)
origin_list_getitematindex = List.GetItemAtIndex(list=map_3, index=code_block_67.out2, lacing=CrossProduct)
code_block_68 = CodeBlock(leftOfOrigin=left_list_getitematindex, rightOfOrigin=right_list_getitematindex, corridorOrigin=origin_list_getitematindex) { leftOfOrigin; rightOfOrigin; corridorOrigin; }

# group: creating FLpointpairs from FLpoints
code_block_69 = CodeBlock(flPoints=code_block_68.leftOfOrigin) { flPoints; }
# note: Creating flPointsPairs from LEFT_OF_AXIS target
byFeaturelinePoints = DynamoROCO.PointsOrganization.ByFeaturelinePoints(points=code_block_69, lacing=Longest)
chordDistanceXY = DynamoROCO.PointPairInfo.ChordDistanceXY(pointPairInfo=byFeaturelinePoints)
firstPointAngle = DynamoROCO.PointPairInfo.FirstPointAngle(pointPairInfo=byFeaturelinePoints)
lastPointAngle = DynamoROCO.PointPairInfo.LastPointAngle(pointPairInfo=byFeaturelinePoints)
first = DynamoROCO.PointPairInfo.First(pointPairInfo=byFeaturelinePoints)
last = DynamoROCO.PointPairInfo.Last(pointPairInfo=byFeaturelinePoints)
code_block_70 = CodeBlock(chordDistancexy=chordDistanceXY, firstPointAngle=firstPointAngle, lastPointAngle=lastPointAngle, firstPoint=first, lastPoint=last) { chordDistancexy; firstPointAngle; lastPointAngle; firstPoint; lastPoint; }

# group: creating pointpair coordinate list
# note: description
code_block_71 = CodeBlock(firstPoint=code_block_70.firstPoint, lastPoint=code_block_70.lastPoint) { firstPoint; lastPoint; }
code_block_72 = CodeBlock(firstList=code_block_71.firstPoint, lastList=code_block_71.lastPoint) { firstList; lastList; }
createpointpairs_from_first_and = Python(IN[0]=code_block_72.firstList, IN[1]=code_block_72.lastList)  # "createPointPairs from first and last point: Python Script"
# ---------- createpointpairs_from_first_and.python (39 lines) ----------
# Load the Python Standard and DesignScript Libraries
import sys
import clr
clr.AddReference('ProtoGeometry')
from Autodesk.DesignScript.Geometry import *

# The inputs to this node will be stored as a list in the IN variables.
firstPointsList, lastPointsList = IN

templist=[]
outlist=[]
i=0
j=0

# Place your code below this line
templist = []
templist1 =[]
outlist = []
i = 0

while i < len(firstPointsList):
    firstPoints = firstPointsList[i]
    lastPoints = lastPointsList[i]
    templist1.Clear()
    j = 0
    while j < len(firstPoints):
    	k = 0
    	templist.Clear()
        while k < len(firstPoints[j]):
            templist.append([firstPoints[j][k], lastPoints[j][k]])
            k += 1
        templist1.append(list(templist))
        j += 1
    outlist.append(list(templist1))
    i += 1


# Assign your output to the OUT variable.
OUT = outlist
# ----------------------------------------
code_block_73 = CodeBlock(pointpairlist_LEFT_OF_ORIGIN=createpointpairs_from_first_and) { pointpairlist_LEFT_OF_ORIGIN; }

# group: creating FLpointpairs from FLpoints
# note: Create flPointPairs from selected FPointCodes
code_block_74 = CodeBlock(flPoints=code_block_64.baseline_fl_points) { flPoints; }
byFeaturelinePoints_2 = DynamoROCO.PointsOrganization.ByFeaturelinePoints(points=code_block_74, lacing=Longest)
chordDistanceXY_2 = DynamoROCO.PointPairInfo.ChordDistanceXY(pointPairInfo=byFeaturelinePoints_2)
firstPointAngle_2 = DynamoROCO.PointPairInfo.FirstPointAngle(pointPairInfo=byFeaturelinePoints_2)
lastPointAngle_2 = DynamoROCO.PointPairInfo.LastPointAngle(pointPairInfo=byFeaturelinePoints_2)
first_2 = DynamoROCO.PointPairInfo.First(pointPairInfo=byFeaturelinePoints_2)
last_2 = DynamoROCO.PointPairInfo.Last(pointPairInfo=byFeaturelinePoints_2)
code_block_75 = CodeBlock(chordDistancexy=chordDistanceXY_2, firstPointAngle=firstPointAngle_2, lastPointAngle=lastPointAngle_2, firstPoint=first_2, lastPoint=last_2) { chordDistancexy; firstPointAngle; lastPointAngle; firstPoint; lastPoint; }

# group: creating pointpair coordinate list
# note: description
code_block_76 = CodeBlock(firstPoint=code_block_75.firstPoint, lastPoint=code_block_75.lastPoint) { firstPoint; lastPoint; }
code_block_77 = CodeBlock(firstList=code_block_76.firstPoint, lastList=code_block_76.lastPoint) { firstList; lastList; }
createpointpairs_from_first_and_2 = Python(IN[0]=code_block_77.firstList, IN[1]=code_block_77.lastList)  # "createPointPairs from first and last point: Python Script"; same code as createpointpairs_from_first_and
code_block_78 = CodeBlock(pointpairlist_selectedFLPoints=createpointpairs_from_first_and_2, firstList=code_block_77.firstList) { pointpairlist_selectedFLPoints; firstList; }

# group: Combines target and axis lists for GMA4
code_block_79 = CodeBlock(pointpairlist_LEFT_OF_ORIGIN=code_block_73, pointpairlist_selectedFLPoints=code_block_78.pointpairlist_selectedFLPoints) { pointpairlist_LEFT_OF_ORIGIN; pointpairlist_selectedFLPoints; }
list_create_4 = List.Create(item0=code_block_79.pointpairlist_selectedFLPoints)
X = Point.X(point=code_block_79.pointpairlist_LEFT_OF_ORIGIN)
Y = Point.Y(point=code_block_79.pointpairlist_LEFT_OF_ORIGIN)
Z = Point.Z(point=code_block_79.pointpairlist_selectedFLPoints)
byCoordinates = Point.ByCoordinates(x=X, y=Y, z=Z)
createpointpairs_from_first_and_3 = Python(IN[0]=code_block_79.pointpairlist_selectedFLPoints, IN[1]=byCoordinates)  # "createPointPairs from first and last point: Python Script"; same code as createpointpairs_from_first_and
move_last_dimension_in_list_up_1_2 = Python(IN[0]=createpointpairs_from_first_and_3)  # "Move last dimension in list up 1 (flatten-1):Python Script"
# ---------- move_last_dimension_in_list_up_1_2.python (29 lines) ----------
# Load the Python Standard and DesignScript Libraries
import sys
import clr
clr.AddReference('ProtoGeometry')
from Autodesk.DesignScript.Geometry import *

# The inputs to this node will be stored as a list in the IN variables.
inlist=IN[0]
templist=[]
templist0=[]
templist1=[]
outlist=[]
# Place your code below this line
for sublist in inlist:
	templist.Clear()
	for item in sublist:
		templist1.Clear()
		for i in item:
			templist0.Clear()
			for j in i:
				for k in j:
					templist0.append(k)
			templist1.append(list(templist0))
		templist.append(list(templist1))
	outlist.append(list(templist))
			
		
# Assign your output to the OUT variable.
OUT = outlist
# ----------------------------------------
list_create_5 = List.Create(item0=move_last_dimension_in_list_up_1_2)
code_block_80 = CodeBlock(poinpairList_GMA2=list_create_4, pointpairlist_GMA4=list_create_5) { poinpairList_GMA2; pointpairlist_GMA4; }

# group: filter for GMA2 or GMA4 info
code_block_81 = CodeBlock(AmountAdaptivePoints=code_block_38.amountAdaptivePoints, poinpairList_GMA2=code_block_80.poinpairList_GMA2, pointpairlist_GMA4=code_block_80.pointpairlist_GMA4) { AmountAdaptivePoints; poinpairList_GMA2; pointpairlist_GMA4; }
code_block_82 = CodeBlock { "GMA2"; "GMA4"; }
byKeysValues_2 = DesignScript.Builtin.Dictionary.ByKeysValues(keys=code_block_82.out0, values=code_block_81.poinpairList_GMA2)
setValueAtKeys_2 = DesignScript.Builtin.Dictionary.SetValueAtKeys(dictionary=byKeysValues_2, keys=code_block_82.out1, values=code_block_81.pointpairlist_GMA4)
valueAtKey_10 = DesignScript.Builtin.Dictionary.ValueAtKey(dictionary=setValueAtKeys_2, key=code_block_81.AmountAdaptivePoints)
code_block_83 = CodeBlock(amountAdaptivePoints=code_block_81.AmountAdaptivePoints, pointpairList_GMA=valueAtKey_10) { amountAdaptivePoints; pointpairList_GMA; }

# group: Creating adaptive components
# note: description
code_block_84 = CodeBlock(familyTypeNames=code_block_54.familyTypeNames, pointpairLists=code_block_83.pointpairList_GMA, corridorNames=code_block_64.corridor, flPointCodes=code_block_54.FlpointCode, familyNames=code_block_54.familyNames) { familyTypeNames; pointpairLists; corridorNames; flPointCodes; familyNames; }
byFamilyNameAndTypeName = FamilyType.ByFamilyNameAndTypeName(familyName=code_block_84.familyNames, typeName=code_block_84.familyTypeNames)
code_block_85 = CodeBlock(familyTypes=byFamilyNameAndTypeName, pointpairLists=code_block_84.pointpairLists, corridorNames=code_block_84.corridorNames, flPointCodes=code_block_84.flPointCodes) { familyTypes; pointpairLists; corridorNames; flPointCodes; }
byPoints = AdaptiveComponent.ByPoints(points=code_block_85.pointpairLists, familyType=code_block_85.familyTypes, lacing=Longest)

# group: format data for inputs and creating inputs for user to enter parameters
# note: description
code_block_86 = CodeBlock(referenceImage=code_block_15.referenceImageObject, Logo=code_block_30.Logo, defaultParameterLists=code_block_62.defaultParameterList, selectedGroupNames=code_block_62.selectedItemNames) { referenceImage; Logo; defaultParameterLists; selectedGroupNames; }
code_block_87 = CodeBlock { "Continue"; 1000; 850; "Cancel"; }
string_23 = StringInput("Instructions:")
string_24 = StringInput("For the object types: enter the start index of de objects")
data_shapes_ui_textnote_data_3 = Custom[Data-Shapes_UI.TextNote Data](Title=string_23, TextNote=string_24)
code_block_88 = CodeBlock { "ROCO_CNU_OBS.Index_start"; "0.0000"; }
code_block_89 = CodeBlock(selectedObjects=code_block_86.selectedGroupNames, keys=code_block_88.out0, values=code_block_88.out1)
# ---------- code_block_89.designscript (8 lines) ----------
selectedObjects;
keys;
values;
count=List.Count(selectedObjects);
paramDict=Dictionary.ByKeysValues(keys, values);
parameterList= List.OfRepeatedItem(paramDict, count);
parameterList.Keys;
parameterList[parameterList.Keys];
# ----------------------------------------
ui_textbox_data = Custom[UI.TextBox Data](InputName=code_block_89.out6, DefaultText=code_block_89.out7)  # package Data-Shapes; Create Data for TextBox input in UI.MultipleInputForm ++ . Check out www.data-shapes.net for more informations
data_shapes_ui_inputgroup_data_5 = Custom[Data-Shapes_UI.InputGroup Data](GroupTitle=code_block_89.selectedObjects, Inputs=ui_textbox_data)
code_block_90 = CodeBlock(item1=data_shapes_ui_textnote_data_3, inList=data_shapes_ui_inputgroup_data_5, item2=code_block_86.referenceImage) { inlist1=List.AddItemToFront(item1, inList); b=List.AddItemToFront(item2,inlist1); c=List.Flatten(b); }
boolean_4 = BoolSelector(true)
passthrough = Custom[Passthrough](passThrough=boolean_4, waitFor=code_block_90.c)  # package Clockwork for Dynamo 2.x; Forces a sequential order of execution. The node wired into the output of the Passthrough node will be executed *after* the node wired into the waitFor input (e.g. important for some Revit operations). The value of the passThrough input will be passed on to the node wired into the output port of the Passthrough node.
code_block_91 = CodeBlock(logo=code_block_86.Logo, ButtonText=code_block_87.out0, inputs=code_block_90.c, objectHasData=passthrough, cancelButtonText=code_block_87.out3, maxHeight=code_block_87.out1, uiWidth=code_block_87.out2, ParameterValueHeaderLists=code_block_89.out6) { Descritpion; logo; ButtonText; inputs; objectHasData; cancelButtonText; maxHeight; uiWidth; ParameterValueHeaderLists; }  # unwired: Descritpion

# group: User enters parameter values for each object type
ui_multipleinputform = Custom[UI.MultipleInputForm ++](Description_optional=code_block_91.Descritpion, Logo_optional=code_block_91.logo, ButtonText_optional=code_block_91.ButtonText, Inputs=code_block_91.inputs, Toggle=code_block_91.objectHasData, CancelButtonText_optional=code_block_91.cancelButtonText, MaxHeight_optional=code_block_91.maxHeight, Width_optional=code_block_91.uiWidth)  # package Data-Shapes; Create a form with multiple inputs. see www.data-shapes.net for tutorials and infos!
code_block_92 = CodeBlock(inList1=ui_multipleinputform.User_Inputs) { List.Chop(inList1,1); }
watch = Watch(code_block_92)

# group: creating PE id for each object (ascending, incrementing by 1)
# note: description
code_block_93 = CodeBlock(adaptiveCompontents=byPoints, parameter_dict_keys=code_block_91.ParameterValueHeaderLists, parameter_dict_values=watch, firstPointsList=code_block_78.firstList) { adaptiveCompontents; parameter_dict_keys; parameter_dict_values; firstPointsList; }
byKeysValues_3 = DesignScript.Builtin.Dictionary.ByKeysValues(keys=code_block_93.parameter_dict_keys, values=code_block_93.parameter_dict_values, lacing=Longest)
string_25 = StringInput("ROCO_CNU_OBS.Index_start")
valueAtKey_11 = DesignScript.Builtin.Dictionary.ValueAtKey(dictionary=byKeysValues_3, key=string_25)
toNumber_2 = String.ToNumber(str=valueAtKey_11)
code_block_94 = CodeBlock { "ROCO_CNU_OBS.Index"; }
create_id_dict_from_list = Python(IN[0]=code_block_93.adaptiveCompontents, IN[1]=toNumber_2, IN[2]=code_block_94)  # "create ID dict from list adaptive components + start offset: Python Script"
# ---------- create_id_dict_from_list.python (41 lines) ----------
# Load the Python Standard and DesignScript Libraries
import sys
import clr
clr.AddReference('ProtoGeometry')
from Autodesk.DesignScript.Geometry import *

# The inputs to this node will be stored as a list in the IN variables.
firstPointsList, idStart, key = IN

templist = []
templist1 =[]
outlist = []
i = 0
j = 0

# Place your code below this line


while i < len(firstPointsList):
    firstPoints = firstPointsList[i]
    index = idStart[i]
    templist1.Clear()
    j = 0
    while j < len(firstPoints):
    	k = 0
    	templist.Clear()
        while k < len(firstPoints[j]):
            index_str = str(index)
            index_str = index_str.split(".")[0]
            index_str = index_str.split(",")[0]
            templist.append({key: int(index_str)})
            index += 1
            k += 1
        templist1.append(list(templist))
        j += 1
    outlist.append(list(templist1))
    i += 1


# Assign your output to the OUT variable.
OUT = outlist
# ----------------------------------------

code_block_95 = CodeBlock(adaptiveComponents=code_block_93.adaptiveCompontents) { List.Count(List.Flatten(adaptiveComponents))==1; }
code_block_96 = CodeBlock(x=toNumber_2) { {"ROCO_CNU_OBS.Index":x}; }
python_script_if = Python(IN[0]=code_block_95, IN[1]=code_block_96, IN[2]=create_id_dict_from_list)
# ---------- python_script_if.python (14 lines) ----------
# Load the Python Standard and DesignScript Libraries
import sys
import clr
clr.AddReference('ProtoGeometry')
from Autodesk.DesignScript.Geometry import *

# The inputs to this node will be stored as a list in the IN variables.

# Place your code below this line
if IN[0]:
	OUT= IN[1];
else:
	OUT= IN[2]
# Assign your output to the OUT variable.
# ----------------------------------------

# group (continued): creating PE id for each object (ascending, incrementing by 1)
code_block_97 = CodeBlock(PE_Id_dict=python_script_if, adaptiveComponents=code_block_93.adaptiveCompontents) { PE_Id_dict; adaptiveComponents; }

# group: creating parameter_value dict for all type objects, including the script info
# note: description
code_block_98 = CodeBlock(parameterDict=byKeysValues_3, removeStartIDValue=string_25, c3DInfoDict=code_block_62.scriptSettings, numberParams=code_block_62.numberParameterNames, configFileMeta=code_block_38.configFileMeta) { parameterDict; removeStartIDValue; c3DInfoDict; numberParams; configFileMeta; }
removeKeys = DesignScript.Builtin.Dictionary.RemoveKeys(dictionary=code_block_98.parameterDict, keys=code_block_98.removeStartIDValue)
code_block_99 = CodeBlock { ["ROCO_CTE_Dynamo.GUID","ROCO_CTE_Dynamo.Script"]; }
generateGuid = DynamoROCO.DesignLog.GenerateGuid()
string_26 = StringInput("ConfigFileMeta")
byKeysValues_4 = DesignScript.Builtin.Dictionary.ByKeysValues(keys=string_26, values=code_block_98.configFileMeta)
string_27 = StringInput("ScriptMeta")
script_CreateMeta = Custom[Script_CreateMeta]()  # package ROCO Dyf Packages; Creates script meta data to put onto object parameters
setValueAtKeys_3 = DesignScript.Builtin.Dictionary.SetValueAtKeys(dictionary=byKeysValues_4, keys=string_27, values=script_CreateMeta)
stringifyJSON = Data.StringifyJSON(values=setValueAtKeys_3, lacing=Longest)
list_create_6 = List.Create(item0=generateGuid, item1=stringifyJSON)
setValueAtKeys_4 = DesignScript.Builtin.Dictionary.SetValueAtKeys(dictionary=removeKeys, keys=code_block_99, values=list_create_6)
string_28 = StringInput("ROCO_CTE_Reference_Source_Data")
code_block_100 = CodeBlock(C3D_Reference_Dict=code_block_98.c3DInfoDict) { C3D_Reference_Dict; }
stringifyJSON_2 = Data.StringifyJSON(values=code_block_100, lacing=Longest)
setValueAtKeys_5 = DesignScript.Builtin.Dictionary.SetValueAtKeys(dictionary=setValueAtKeys_4, keys=string_28, values=stringifyJSON_2, lacing=Longest)
code_block_101 = CodeBlock(numberParams=code_block_98.numberParams) { numberParams; }
valueAtKey_12 = DesignScript.Builtin.Dictionary.ValueAtKey(dictionary=setValueAtKeys_4, key=code_block_101)
toNumber_3 = String.ToNumber(str=valueAtKey_12)
code_block_102 = CodeBlock(in_dict=setValueAtKeys_5, keys=code_block_101, values=toNumber_3) { in_dict; keys; values; }
create_parameter_dictionary = Python(IN[0]=code_block_102.in_dict, IN[1]=code_block_102.keys, IN[2]=code_block_102.values)  # "create parameter dictionary: Python Script"
# ---------- create_parameter_dictionary.python (30 lines) ----------
# Load the Python Standard and DesignScript Libraries
import sys
import clr
clr.AddReference('ProtoGeometry')
from Autodesk.DesignScript.Geometry import *

# The inputs to this node will be stored as a list in the IN variables.
in_list, add_keys, add_values =IN

tempdict ={}
outlist=[]
templist=[]
# Place your code below this line
i=0
while i< len(in_list):
	in_dict=in_list[i]
	keylist=add_keys[i]
	valuelist=add_values[i]
	j=0
	while j< len(keylist):
		in_dict[keylist[j]]=valuelist[j]	
		j+=1
	outlist.append(in_dict)
	i+=1

	
		
	
# Assign your output to the OUT variable.
OUT = outlist
# ----------------------------------------
code_block_103 = CodeBlock(parameterDict=create_parameter_dictionary) { parameterDict; }

# group: createBaselineStationDict
code_block_104 = CodeBlock(baselineStations=code_block_64.baselineStations) { baselineStations; }
code_block_105 = CodeBlock { ["ROCO_CNU_Station"]; }
createstationdict_from_baseline = Python(IN[0]=code_block_104, IN[1]=code_block_105)  # "createStationDict from baseline stations: Python Script"
# ---------- createstationdict_from_baseline.python (39 lines) ----------
# Load the Python Standard and DesignScript Libraries
import sys
import clr
clr.AddReference('ProtoGeometry')
from Autodesk.DesignScript.Geometry import *

# The inputs to this node will be stored as a list in the IN variables.
firstItemsList, keyList = IN

templist = []
templist1 = []
outlist = []
i = 0

while i < len(firstItemsList):
    firstPoints = firstItemsList[i]

    templist1.Clear()
    j = 0
    while j < len(firstPoints):
        k = 0
        templist.Clear()
        while k < len(firstPoints[j]):
            object = firstPoints[j][k]
            n = 0
            tempdict = {}
            while n < len(keyList):
                tempdict[keyList[n]] = object
                n += 1
            templist.append(tempdict)
            k += 1
        templist1.append(list(templist))
        j += 1
    outlist.append(list(templist1))
    i += 1


# Assign your output to the OUT variable.
OUT = outlist
# ----------------------------------------
code_block_106 = CodeBlock(stationDict=createstationdict_from_baseline) { stationDict; }

# group: creating point rotation list
# note: description
code_block_107 = CodeBlock(firstPointAngle=code_block_75.firstPointAngle, lastPointAngle=code_block_75.lastPointAngle) { firstPointAngle; lastPointAngle; }
code_block_108 = CodeBlock { -1; }
mul = code_block_107.firstPointAngle * code_block_108
code_block_109 = CodeBlock { -180; }
sub = mul - code_block_109
mul_2 = code_block_107.lastPointAngle * code_block_108
sub_2 = mul_2 - code_block_109
code_block_110 = CodeBlock(firstList=sub, lastList=sub_2) { firstList; lastList; }
createpointpairs_from_first_and_4 = Python(IN[0]=code_block_110.firstList, IN[1]=code_block_110.lastList)  # "createPointPairs from first and last point: Python Script"; same code as createpointpairs_from_first_and
code_block_111 = CodeBlock()
# ---------- code_block_111.designscript (2 lines) ----------
["ROCO_CDG_Rotation_E_pt1",
"ROCO_CDG_Rotation_E_pt2"];
# ----------------------------------------
createpointpairdict_from_first = Python(IN[0]=createpointpairs_from_first_and_4, IN[1]=code_block_111)  # "createPointPairDict from first and last point: Python Script"
# ---------- createpointpairdict_from_first.python (39 lines) ----------
# Load the Python Standard and DesignScript Libraries
import sys
import clr
clr.AddReference('ProtoGeometry')
from Autodesk.DesignScript.Geometry import *

# The inputs to this node will be stored as a list in the IN variables.
firstItemsList, keyList = IN

templist = []
templist1 = []
outlist = []
i = 0

while i < len(firstItemsList):
    firstPoints = firstItemsList[i]

    templist1.Clear()
    j = 0
    while j < len(firstPoints):
        k = 0
        templist.Clear()
        while k < len(firstPoints[j]):
            pairList = firstPoints[j][k]
            n = 0
            tempdict = {}
            while n < len(keyList):
                tempdict[keyList[n]] = pairList[n]
                n += 1
            templist.append(tempdict)
            k += 1
        templist1.append(list(templist))
        j += 1
    outlist.append(list(templist1))
    i += 1


# Assign your output to the OUT variable.
OUT = outlist
# ----------------------------------------
code_block_112 = CodeBlock(rotation_profiles=createpointpairdict_from_first) { rotation_profiles; }

code_block_113 = CodeBlock { 1; }

# group: compiling parameter list and setting parameters on elements
# note: description
code_block_114 = CodeBlock(adaptiveComponents=code_block_97.adaptiveComponents, pe_id_dict=code_block_97.PE_Id_dict, defaultParameterList=code_block_103, stationsDict=code_block_106, objectRotationDict=code_block_112) { adaptiveComponents; pe_id_dict; defaultParameterList; stationsDict; objectRotationDict; }
flatten_6 = List.Flatten(list=code_block_114.adaptiveComponents, amt=code_block_113)
flatten_7 = List.Flatten(list=code_block_114.pe_id_dict)
flatten_8 = List.Flatten(list=code_block_114.stationsDict)
flatten_9 = List.Flatten(list=code_block_114.objectRotationDict)

flatten_10 = List.Flatten(list=flatten_6)
flatten_11 = List.Flatten(list=code_block_114.defaultParameterList)
count_2 = List.Count(list=flatten_6, lacing=Longest)
ofRepeatedItem = List.OfRepeatedItem(item=flatten_11, amount=count_2, lacing=Longest)
flatten_12 = List.Flatten(list=ofRepeatedItem)
dictionaryupdate = Custom[dictionaryupdate](targetDict=flatten_8, addDict=flatten_9)  # package ROCO Dyf Packages; Updates dictionary with another dict
dictionaryupdate_2 = Custom[dictionaryupdate](targetDict=flatten_7, addDict=dictionaryupdate)
dictionaryupdate_3 = Custom[dictionaryupdate](targetDict=flatten_12, addDict=dictionaryupdate_2)
setParameters = Custom[Element.SetParameters](elementInstance=flatten_10, parameterDict=dictionaryupdate_3, lacing=Longest)  # package ROCO Dyf Packages; Sets parameters based on element and parameter dict

# group (continued): compiling parameter list and setting parameters on elements
parameters_set_0_watch = Watch(setParameters)  # graph output
