# Dynamo graph CC_GMA2_createObjects_wo_dimensions@IntervalCorridorFLpoints.dyn (Dynamo 2.3.0.5885)
# packages: Data-Shapes 2019.2.40, archi-lab.net 2020.22.9, DynamoROCO 2.3.0.0, ROCO Dyf Packages 1.0.0, Clockwork for Dynamo 2.x 2.1.2

# group: DATA MANIPULATION
# note: Data manipulation on Dynamo Objects

# group: NOT IN USE
# note: Nodes to consider part of the final graph

# group: INPUT
# note: Data input and preperation for other nodes

# group: GET
# note: Get parameter values from Revit objects

# group: DEBUG
# note: Check if the graph is working as expected

# group: Package
# note: All used nodes from a package have a prefix
# added to them with the name of the node.

# group: FUNCTION
# note: Creation of dynamo objects

# group: OUTPUT
# note: Object creation in Revit, final output

# group: SET
# note: Set parameters on Revit objects

# group: INFO
# note: GENERAL INFO
# Version: 3
# Author: Dick Elsman
# Company: Infranea | ROCO
# email: dick.elsman@infranea.com
# Dynamo Core version: 2.3.0.5885
# Dynamo Revit version: 2.3.0.6270
# Revit version: 2020.2
# note: INSTRUCTIONS
# <DESCRIPTION>
# Allows the user to place GMA2 objects on featureline points in the direction of the alignment (and corridor).  Duration of scripts depends on complexity of corridor and to be placed objects. Min runtime is about 5 minutes
# <INSTRUCTIONS>
# navigate to the folder to play, and press play in the Dynamo Player.
# NB! This script requires a JSON config file for it to index objects and data from sources. This/these file(s) shoudl be stored in <script directory>\config_files
# note: KNOWN ISSUES AND LIMITATIONS
# - Does not support retaining objects yet
# - Does not yet facilitate slopes in floors
# note: SCRIPT META
# Script Name: CC_GMA2_GMA4_createObjects@CorridorFLpoints.dyn
# Packages used in this script:
# Data-Shapes version: 2019.2.40
# Clockwork for Dynamo 2.x version: 2.1.2
# DynamoROCO version: 2.3.0.0
# ROCO Dyf Packages version: 1.0.0
# TimeStamp : 2020/2/6 17:58

# group: User selects config file to run script with
readConfigFileDirectory = Custom[readConfigFileDirectory]()  # package ROCO Dyf Packages; Import config file names stored in workspace, output UI objects for Data-Shapes containing filenames
code_block = CodeBlock(chars=readConfigFileDirectory.strLength) { Math.Max(500, Math.Round(200*chars/25 + 0.5*chars)); }
data_shapes_ui_multipleinputform = Custom[Data-Shapes_UI.MultipleInputForm ++](Description_optional=readConfigFileDirectory.description, Logo_optional=readConfigFileDirectory.logo, ButtonText_optional=readConfigFileDirectory.buttonText, Inputs=readConfigFileDirectory.UIObjects, Toggle=readConfigFileDirectory.hasData, CancelButtonText_optional=readConfigFileDirectory.cancelButton, Width_optional=code_block)  # package Data-Shapes; Create a form with multiple inputs. see www.data-shapes.net for tutorials and infos!
code_block_2 = CodeBlock(x=data_shapes_ui_multipleinputform.User_Inputs) { selectedConfigFile=x[0]; }

# group: Import JSON file for script config
code_block_3 = CodeBlock(selectedConfigFile=code_block_2) { selectedConfigFile; }
code_block_4 = CodeBlock { 0; }
getItemAtIndex = List.GetItemAtIndex(list=code_block_3, index=code_block_4)
readText = FileSystem.ReadText(file=getItemAtIndex)
parseJSON = Data.ParseJSON(json=readText)
code_block_5 = CodeBlock { "scriptDataDict"; "imageDict"; "configData"; }
valueAtKey = DesignScript.Builtin.Dictionary.ValueAtKey(dictionary=parseJSON, key=code_block_5.out1)
valueAtKey_2 = DesignScript.Builtin.Dictionary.ValueAtKey(dictionary=parseJSON, key=code_block_5.out0)
valueAtKey_3 = DesignScript.Builtin.Dictionary.ValueAtKey(dictionary=parseJSON, key=code_block_5.out2)
code_block_6 = CodeBlock { "#adaptivePoints"; }
valueAtKey_4 = DesignScript.Builtin.Dictionary.ValueAtKey(dictionary=valueAtKey_3, key=code_block_6)
code_block_7 = CodeBlock(imageDict=valueAtKey, scriptSettingsDict=valueAtKey_2, amountAdaptivePoints=valueAtKey_4, configFileMeta=valueAtKey_3) { imageDict; scriptSettingsDict; amountAdaptivePoints; configFileMeta; }

# group: Creating image data for use in script
# note: Converting the imported json into 2 filepath, 1 for the logo in the UI, the other as reference image in the UI
code_block_8 = CodeBlock(JSONImportPictureData=code_block_7.imageDict) { JSONImportPictureData; }
code_block_9 = CodeBlock { "Logo"; "ReferenceImage"; }
valueAtKey_5 = DesignScript.Builtin.Dictionary.ValueAtKey(dictionary=code_block_8, key=code_block_9.out0)
fromPath = FileObject(path=valueAtKey_5)  # "File.FromPath"
readFromFile = Image.ReadFromFile(file=fromPath)
code_block_10 = CodeBlock(Logo=readFromFile) { Logo; }
string = StringInput("Reference image")
valueAtKey_6 = DesignScript.Builtin.Dictionary.ValueAtKey(dictionary=code_block_8, key=code_block_9.out1)
fromPath_2 = FileObject(path=valueAtKey_6)  # "File.FromPath"
string_from_object = FromObject(obj=fromPath_2)
filepath_from_string_python = Python(IN[0]=string_from_object)  # "filepath from string:python script"
# ---------- filepath_from_string_python.python (14 lines) ----------
# Load the Python Standard and DesignScript Libraries
import sys
import clr
import os
clr.AddReference('ProtoGeometry')
from Autodesk.DesignScript.Geometry import *

# The inputs to this node will be stored as a list in the IN variables.


# Place your code below this line

# Assign your outputto the OUT variable.
OUT = os.path.join(IN[0])
# ----------------------------------------
boolean = BoolSelector(false)
data_shapes_ui_image_data = Custom[Data-Shapes_UI.Image Data](Image=filepath_from_string_python, ShowBorder_optional=boolean)  # package Data-Shapes; Places an image on UI.MultipleInutForm ++ .
data_shapes_ui_inputgroup_data = Custom[Data-Shapes_UI.InputGroup Data](GroupTitle=string, Inputs=data_shapes_ui_image_data)  # package Data-Shapes; Creates a group of inputs for UI.MultipleInputForm ++ . Check out www.data-shapes.net for more infos !
code_block_11 = CodeBlock(LogoImage=code_block_10, referenceImageObject=data_shapes_ui_inputgroup_data) { LogoImage; referenceImageObject; }

# group: Importing civil documents from application and fomratting for selecting corridor and FPcodes in UI
# note: description
string_2 = StringInput("Select only 1 FL point code below!")
civilApplication_GetFLPCodesAsString = Custom[civilApplication_GetFLPCodesAsString]()  # package ROCO Dyf Packages; gets corridor names form all open CivilDocuments, outputting it in list with format "Doc | Corridor | FLPointsCodes"
code_block_12 = CodeBlock { false; 75; }
ui_treeview_input = Custom[UI.TreeView input](InputName=string_2, Data=civilApplication_GetFLPCodesAsString.flPointCodes, FirstItemIsTitle=code_block_12.out0, Height=code_block_12.out1)  # package Data-Shapes; Create a TreeView input for UI.MultipleInputForm ++ . Check out www.data-shapes.net for more infos and tips!
code_block_13 = CodeBlock(UIobject=ui_treeview_input, stringLength=civilApplication_GetFLPCodesAsString.stringLength, civilApplication=civilApplication_GetFLPCodesAsString.civilApplication, Separator=civilApplication_GetFLPCodesAsString.stringSeparator) { UIobject; stringLength; civilApplication; Separator; }

# group: Building dictionary for use in UI
# note: building UI data to feed the listview for selecting type objects
code_block_14 = CodeBlock(scriptDataDict=code_block_7.scriptSettingsDict) { scriptDataDict; }
keys = DesignScript.Builtin.Dictionary.Keys(dictionary=code_block_14)
toNumber = String.ToNumber(str=keys)
sortListByAnother = archilab.Lists.Lists.SortListByAnother(list=keys, sortBy=toNumber)
string_3 = StringInput(" : ")
operators = sortListByAnother.list + string_3
valueAtKey_7 = DesignScript.Builtin.Dictionary.ValueAtKey(dictionary=code_block_14, key=sortListByAnother.list)
string_4 = StringInput("name")
valueAtKey_8 = DesignScript.Builtin.Dictionary.ValueAtKey(dictionary=valueAtKey_7, key=string_4)
operators_2 = operators + valueAtKey_8
code_block_15 = CodeBlock(listviewDisplayData=operators_2, sorted_dict_keys=sortListByAnother.list) { listviewDisplayData; sorted_dict_keys; }

code_block_16 = CodeBlock(imageDict=code_block_7.imageDict, scriptSettingsDict=code_block_7.scriptSettingsDict, amountAdaptivePoints=code_block_7.amountAdaptivePoints, configFileMeta=code_block_7.configFileMeta) { imageDict; scriptSettingsDict; amountAdaptivePoints; configFileMeta; }

# group: creating input values for selecting type objects
string_5 = StringInput("Input how much alternating objects you have (interpret blanks as objects)")
# note: description
code_block_17 = CodeBlock(uiLogo=code_block_11.LogoImage) { uiLogo; }
string_6 = StringInput("Continue")
code_block_18 = CodeBlock { "# alternating objects"; "2"; false; }
ui_textbox_data = Custom[UI.TextBox Data](InputName=code_block_18.out0, DefaultText=code_block_18.out1, IsNumberEntry=code_block_18.out2)  # package Data-Shapes; Create Data for TextBox input in UI.MultipleInputForm ++ . Check out www.data-shapes.net for more informations
list_create = List.Create(item0=ui_textbox_data)
data_shapes_ui_inputgroup_data_2 = Custom[Data-Shapes_UI.InputGroup Data](GroupTitle=string_5, Inputs=list_create)
boolean_2 = BoolSelector(true)
code_block_19 = CodeBlock { "Cancel"; 1000; 500; }
code_block_20 = CodeBlock(Descritpion=string_5, logo=code_block_17, ButtonText=string_6, inputs=data_shapes_ui_inputgroup_data_2, objectHasData=boolean_2, cancelButtonText=code_block_19.out0, maxHeight=code_block_19.out1, uiWidth=code_block_19.out2) { Descritpion; logo; ButtonText; inputs; objectHasData; cancelButtonText; maxHeight; uiWidth; }

# group: User selects
# note: User selects which objects to place
data_shapes_ui_multipleinputform_2 = Custom[Data-Shapes_UI.MultipleInputForm ++](Description_optional=code_block_20.Descritpion, Logo_optional=code_block_20.logo, ButtonText_optional=code_block_20.ButtonText, Inputs=code_block_20.inputs, Toggle=code_block_20.objectHasData, CancelButtonText_optional=code_block_20.cancelButtonText, MaxHeight_optional=code_block_20.maxHeight, Width_optional=code_block_20.uiWidth)
code_block_21 = CodeBlock { null; }
if_ = If(test=data_shapes_ui_multipleinputform_2.Was_Cancelled, true=code_block_21, false=data_shapes_ui_multipleinputform_2.User_Inputs)
code_block_22 = CodeBlock(intervalFreq=if_) { intervalFreq; }

# group: Filtering scritpDataDict based on selected items
# note: description
code_block_23 = CodeBlock(scriptDataDict=code_block_16.scriptSettingsDict) { scriptDataDict[scriptDataDict.Keys]; scriptDataDict.Keys; }
flatten = List.Flatten(list=code_block_23.out1)
string_7 = StringInput(" : ")
operators_3 = flatten + string_7
string_8 = StringInput("name")
designscriptbuiltin = DesignScript.Builtin.Dictionary.ValueAtKey(dictionary=code_block_23.out0, key=string_8)
operators_4 = operators_3 + designscriptbuiltin
code_block_24 = CodeBlock(selectedObjectDicts=code_block_23.out0, selectedObjectTypeNames=operators_4) { selectedObjectDicts; selectedObjectTypeNames; }

# group: Filter families in project based on search query of config_file
code_block_25 = CodeBlock { "filters targetlist based on string: "; "'|' is used to define 'or'"; "',' is used to define 'and'"; }
# note: filter Family object items based on string
string_9 = StringInput("fam_search")
designscriptbuiltin_2 = DesignScript.Builtin.Dictionary.ValueAtKey(dictionary=code_block_24.selectedObjectDicts, key=string_9)
element_types = ElementTypes("Family")
all_elements_of_type = ElementsOfType(element_type=element_types)
name = Element.Name(element=all_elements_of_type)
boolean_3 = BoolSelector(true)
code_block_26 = CodeBlock(filters=designscriptbuiltin_2, targetList=name, ignoreCase=boolean_3) { filters; targetList; ignoreCase; }
list_Filterbystring = Custom[List_Filterbystring](TargetList=code_block_26.targetList, Filterlist=code_block_26.filters, ignorCase=code_block_26.ignoreCase)  # package ROCO Dyf Packages; Filters targetlist based on string: | is used to define 'or' , is used to define 'and'
code_block_27 = CodeBlock { "match"; }
valueAtKey_9 = DesignScript.Builtin.Dictionary.ValueAtKey(dictionary=list_Filterbystring, key=code_block_27)
familySelectionUIData_FromName = Custom[FamilySelectionUIData_FromName](familyName=valueAtKey_9)  # package ROCO Dyf Packages; Creates family ui data from Family Names

# group: creating input values for selecting type objects
code_block_28 = CodeBlock(UIobject=code_block_13.UIobject, stringLength=code_block_13.stringLength, civilApplication=code_block_13.civilApplication, Separator=code_block_13.Separator) { UIobject; chars=stringLength; Math.Max(500, Math.Round(200*chars/25 + 0.5*chars)); civilApplication; Separator; }
code_block_29 = CodeBlock { 1; }
code_block_30 = CodeBlock(listviewDisplayData=code_block_15.listviewDisplayData, sorted_dict_keys=code_block_15.sorted_dict_keys, referenceImage=code_block_11.referenceImageObject, uiLogo=code_block_11.LogoImage, scriptSettingsDict=code_block_16.scriptSettingsDict, frequency=code_block_22, filteredFamilyStr=familySelectionUIData_FromName.inputFamilyTypeString, filteredFamilyObj=familySelectionUIData_FromName.familyTypes)
# ---------- code_block_30.designscript (8 lines) ----------
listviewDisplayData;
sorted_dict_keys;
referenceImage;
uiLogo;
scriptSettingsDict;
String.ToNumber(frequency);
filteredFamilyStr;
filteredFamilyObj;
# ----------------------------------------
# note: description
range = Range(start=code_block_29, end=code_block_30.out5, step=code_block_29)
code_block_31 = CodeBlock(x=range, z=code_block_30.scriptSettingsDict, frequency=code_block_30.out5, filteredFamilieStr=code_block_30.filteredFamilyStr, filteredFamilieObj=code_block_30.filteredFamilyObj)
# ---------- code_block_31.designscript (9 lines) ----------
y=List.Flatten(x)+"";
ScriptSettingsList=List.Flatten(List.OfRepeatedItem(z[z.Keys],frequency),2);
ScriptSettingsDict=Dictionary.ByKeysValues(y,ScriptSettingsList);
y+": "+ScriptSettingsList["name"];
familyTypeStrList=List.Flatten(List.OfRepeatedItem(filteredFamilieStr,frequency),2);
familyTypeObjList=List.Flatten(List.OfRepeatedItem(filteredFamilieObj,frequency),2);
"Blanco";
chars=List.MaximumItem(String.Length(List.Flatten(familyTypeStrList)));
Math.Max(500, Math.Round(200*chars/25 + 0.5*chars));
# ----------------------------------------
code_block_32 = CodeBlock(civilApplication=code_block_28.civilApplication, Separator=code_block_28.Separator, groupNames=code_block_31.out3) { civilApplication; Separator; groupNames; }
string_10 = StringInput("Input which objects you want to place, and enter the frequency.")
string_11 = StringInput("Continue")
string_12 = StringInput("Instructions")
string_13 = StringInput("""Select for each array object the type, frequency and host object.
make sure the selected FLPoint are on the same corridor. If the alternation happens with a blank, instead of a family type, select "blanco".""")
ui_textnote_data = Custom[UI.TextNote Data](Title=string_12, TextNote=string_13)  # package Data-Shapes; Create Data for TextNote input in UI.MultipleInputForm ++ . Check out www.data-shapes.net for more informations
code_block_33 = CodeBlock { "Select Family + Type"; "Repetition"; "1"; false; 0; }
ui_textbox_data_2 = Custom[UI.TextBox Data](InputName=code_block_33.out1, DefaultText=code_block_33.out2, IsNumberEntry=code_block_33.out3)
addItemToFront = List.AddItemToFront(item=code_block_31.out6, list=code_block_31.familyTypeStrList, lacing=CrossProduct)
addItemToFront_2 = List.AddItemToFront(item=code_block_31.out6, list=code_block_31.familyTypeObjList, lacing=CrossProduct)
ui_dropdown_data = Custom[UI.DropDown Data](InputName=code_block_33.out0, Keys=addItemToFront, Values=addItemToFront_2, DefaultValueIndex=code_block_33.out4)  # package Data-Shapes; Create data for DropDown input in UI.MultiInputForm ++ . Check out www.data-shapes.net for more infos.
addItemToEnd = List.AddItemToEnd(item=ui_textbox_data_2, list=ui_dropdown_data, lacing=CrossProduct)
addItemToEnd_2 = List.AddItemToEnd(item=code_block_28.UIobject, list=addItemToEnd, lacing=CrossProduct)
data_shapes_ui_inputgroup_data_3 = Custom[Data-Shapes_UI.InputGroup Data](GroupTitle=code_block_31.out3, Inputs=addItemToEnd_2)
boolean_4 = BoolSelector(true)
code_block_34 = CodeBlock { "Cancel"; 1000; }
max = Math.Max(value1=code_block_31.out8, value2=code_block_28.out2)

code_block_35 = CodeBlock(referenceImage=code_block_11.referenceImageObject, groupNames=code_block_32.groupNames, Logo=code_block_11.LogoImage, civilApplication=code_block_32.civilApplication) { referenceImage; groupNames; Logo; civilApplication; }
addItemToFront_3 = List.AddItemToFront(item=ui_textnote_data, list=data_shapes_ui_inputgroup_data_3)

# group (continued): creating input values for selecting type objects
code_block_36 = CodeBlock(Descritpion=string_10, logo=code_block_30.uiLogo, ButtonText=string_11, inputs=addItemToFront_3, objectHasData=boolean_4, cancelButtonText=code_block_34.out0, maxHeight=code_block_34.out1, uiWidth=max, scriptSettingsDict=code_block_31.ScriptSettingsDict) { Descritpion; logo; ButtonText; inputs; objectHasData; cancelButtonText; maxHeight; uiWidth; scriptSettingsDict; }

# group: User selects Family types, frequency, and C3D host
# note: User selects which objects to place
data_shapes_ui_multipleinputform_3 = Custom[Data-Shapes_UI.MultipleInputForm ++](Description_optional=code_block_36.Descritpion, Logo_optional=code_block_36.logo, ButtonText_optional=code_block_36.ButtonText, Inputs=code_block_36.inputs, Toggle=code_block_36.objectHasData, CancelButtonText_optional=code_block_36.cancelButtonText, MaxHeight_optional=code_block_36.maxHeight, Width_optional=code_block_36.uiWidth)
code_block_37 = CodeBlock { null; }
if_2 = If(test=data_shapes_ui_multipleinputform_3.Was_Cancelled, true=code_block_37, false=data_shapes_ui_multipleinputform_3.User_Inputs)
code_block_38 = CodeBlock(selectedItems=if_2) { List.Chop(List.Flatten(selectedItems),3); }

# group: Create FLPointPairs
code_block_39 = CodeBlock(groupNames=code_block_35.groupNames, selectedFamilyTypesAndCivilData=code_block_38, stringSeperator=code_block_32.Separator, referenceImage=code_block_35.referenceImage, Logo=code_block_35.Logo, civilApplication=code_block_35.civilApplication, scriptSettingsDict=code_block_36.scriptSettingsDict)
# ---------- code_block_39.designscript (7 lines) ----------
groupNames;
selectedFamilyTypesAndCivilData;
stringSeperator;
referenceImage;
Logo;
civilApplication;
scriptSettingsDict;
# ----------------------------------------
code_block_40 = CodeBlock(CAPP=code_block_39.civilApplication, x=code_block_39.selectedFamilyTypesAndCivilData, Separator=code_block_39.stringSeperator)
# ---------- code_block_40.designscript (11 lines) ----------
CAPP;
familyTypes=List.Transpose(x)[0];
blank = familyTypes!="Blanco";
frequency=String.ToNumber(List.Transpose(x)[1]);
List.OfRepeatedItem(0,List.Count(familyTypes));
civilDataStr=List.Transpose(String.Split(List.Transpose(x)[2],Separator));
civilDoc=CAPP.GetDocumentByName(civilDataStr[0]);
civilCor=civilDoc.GetCorridorByName(civilDataStr[1]);
civilBL=Corridor.Baselines(civilCor);
civilFLP=List.Flatten(Baseline.GetFeaturelinePointsByCode(civilBL,civilDataStr[2]),2);
civilStations=FeaturelinePoint.Station(civilFLP);
# ----------------------------------------
count = List.Count(list=code_block_40.civilFLP, lacing=Longest)
code_block_41 = CodeBlock(frequency=code_block_40.frequency, length=count) { frequency; length; }
calculate_sequence_of_index = Python(IN[0]=code_block_41.frequency, IN[1]=code_block_41.length)  # "calculate sequence of index: Python Script"
# ---------- calculate_sequence_of_index.python (49 lines) ----------
# Load the Python Standard and DesignScript Libraries
import sys
import clr
clr.AddReference('ProtoGeometry')
from Autodesk.DesignScript.Geometry import *

# The inputs to this node will be stored as a list in the IN variables.
freq, endIndex = IN
i=0
j=0
n=0
itemIndex=int()
arrayLength=0
outList=[]
sequence=[]

# Place your code below this line
def sumList(l):
	sum=0
	for x in l:
		sum+=x
	return sum

arrayLength= sumList(freq)

while i< len(freq):
	sequence.Clear()
	f=freq[i]
	interval = arrayLength - f+1
	startIndex= sumList(freq[:i])
	j=0
	itemIndex=0
	while j<endIndex[i]-1:
		
		itemIndex = startIndex + j*interval
		if j>0:
			itemIndex+=f*j-j
		n=0
		while n<f:
			if itemIndex<endIndex[i]-1:
				sequence.append(itemIndex)
			itemIndex+=1
			n+=1
		j+=1
	outList.append(list(sequence))
	i+=1

# Assign your output to the OUT variable.
OUT = outList
# ----------------------------------------
code_block_42 = CodeBlock(x=calculate_sequence_of_index, civilFLPoints=code_block_40.civilFLP) { x; x+1; civilFLPoints; }
getItemAtIndex_2 = List.GetItemAtIndex(list=code_block_42.civilFLPoints, index=code_block_42.x, lacing=Longest)
count_2 = List.Count(list=getItemAtIndex_2, lacing=Longest)
getItemAtIndex_3 = List.GetItemAtIndex(list=code_block_42.civilFLPoints, index=code_block_42.out1, lacing=Longest)
addItemToEnd_3 = List.AddItemToEnd(item=getItemAtIndex_3, list=getItemAtIndex_2, lacing=Longest)
code_block_43 = CodeBlock(x=count_2, n=addItemToEnd_3) { x; List.Chop(x,1); x*2; List.Flatten(n); }
chop = List.Chop(list=code_block_43.out3, lengths=code_block_43.out2)
chop_2 = List.Chop(list=chop, lengths=code_block_43.out1, lacing=Longest)
transpose = List.Transpose(lists=chop_2, lacing=Longest)
code_block_44 = CodeBlock(FLP=transpose, familyType=code_block_40.familyTypes, civilDataStr=code_block_40.civilDataStr, mask=code_block_40.blank, Startpoints=getItemAtIndex_2, groupNames=code_block_39.groupNames, scriptSettings=code_block_39.scriptSettingsDict)
# ---------- code_block_44.designscript (13 lines) ----------
FLP;
familyType;
civilDataStr;
mask;
stations=List.FilterByBoolMask(Startpoints,mask)["in"].Station;
FLPs=List.FilterByBoolMask(FLP,mask)["in"];
FTList=List.FilterByBoolMask(familyType, mask)["in"];
civilDocName=List.FilterByBoolMask(civilDataStr[0],mask)["in"];
civilCorName=List.FilterByBoolMask(civilDataStr[1],mask)["in"];
civilFPLCode=List.FilterByBoolMask(civilDataStr[2],mask)["in"];
groupNames;
scriptSettings;
positions=FeaturelinePoint.Position(FLPs);
# ----------------------------------------

# group: splitting table data and filtering out obsolete items
code_block_45 = CodeBlock(objectNames=code_block_44.groupNames, familyTypes=code_block_44.FTList, civilDocumentName=code_block_44.civilDocName, corridorName=code_block_44.civilCorName, FlpointCode=code_block_44.civilFPLCode, positions=code_block_44.positions, scriptSettings=code_block_44.scriptSettings, configfileMeta=code_block_16.configFileMeta)  # unwired: filteredTableContent, objectTypes
# ---------- code_block_45.designscript (10 lines) ----------
filteredTableContent;
objectTypes;
objectNames;
familyTypes;
civilDocumentName;
corridorName;
FlpointCode;
positions;
scriptSettings;
configfileMeta;
# ----------------------------------------

# group: Obtaining type ID's to filter settings dictionary
# note: description
code_block_46 = CodeBlock(objectNames=code_block_45.objectNames) { objectNames; }
string_14 = StringInput(": ")
split = String.Split(str=code_block_46, separator0=string_14)
code_block_47 = CodeBlock { 0; }
getItemAtIndex_4 = List.GetItemAtIndex(index=code_block_47)  # unwired: list
map = List.Map(list=split, f_x=getItemAtIndex_4)
code_block_48 = CodeBlock(selectedObjectKeys=map) { selectedObjectKeys; }

# group: Creating reference info dict for objects
# note: description
code_block_49 = CodeBlock(civilDocumentName=code_block_45.civilDocumentName, corridorName=code_block_45.corridorName, flPointCode=code_block_45.FlpointCode) { civilDocumentName; corridorName; flPointCode; }
C3DMeta_CorridorFLPoints = Custom[C3DMeta_CorridorFLPoints](civilDocumentName=code_block_49.civilDocumentName, corridorName=code_block_49.corridorName, flPointCode=code_block_49.flPointCode)  # package ROCO Dyf Packages; create metadata script for corridorflPoint scripts
code_block_50 = CodeBlock(c3dInfoDict=C3DMeta_CorridorFLPoints) { c3dInfoDict; }

# group: creating diverse dicts to continue script
# note: description
code_block_51 = CodeBlock(settingsDict=code_block_45.scriptSettings, selectedObjectKeys=code_block_48, c3dInfo=code_block_50) { settingsDict; selectedObjectKeys; c3dInfo; }
flatten_2 = List.Flatten(list=code_block_51.selectedObjectKeys)
designscriptbuiltin_3 = DesignScript.Builtin.Dictionary.ValueAtKey(dictionary=code_block_51.settingsDict, key=flatten_2)
byKeysValues = DesignScript.Builtin.Dictionary.ByKeysValues(keys=flatten_2, values=designscriptbuiltin_3)
string_15 = StringInput("defaultParameters")
designscriptbuiltin_4 = DesignScript.Builtin.Dictionary.ValueAtKey(dictionary=designscriptbuiltin_3, key=string_15)
string_16 = StringInput(" : ")
operators_5 = flatten_2 + string_16
string_17 = StringInput("name")
designscriptbuiltin_5 = DesignScript.Builtin.Dictionary.ValueAtKey(dictionary=designscriptbuiltin_3, key=string_17)
operators_6 = operators_5 + designscriptbuiltin_5
string_18 = StringInput("numberParams")
designscriptbuiltin_list_of = DesignScript.Builtin.Dictionary.ValueAtKey(dictionary=designscriptbuiltin_3, key=string_18)
string_19 = StringInput("C3D info")
setValueAtKeys = DesignScript.Builtin.Dictionary.SetValueAtKeys(dictionary=designscriptbuiltin_3, keys=string_19, values=code_block_51.c3dInfo, lacing=Longest)
code_block_52 = CodeBlock { ["fam_search","defaultParameters","numberParams"]; }
designscriptbuiltin_prepare_dict = DesignScript.Builtin.Dictionary.RemoveKeys(dictionary=setValueAtKeys, keys=code_block_52)
code_block_53 = CodeBlock(defaultParameterList=designscriptbuiltin_4, selectedItemNames=operators_6, numberParameterNames=designscriptbuiltin_list_of, scriptSettings=designscriptbuiltin_prepare_dict) { defaultParameterList; selectedItemNames; numberParameterNames; scriptSettings; }

code_block_54 = CodeBlock(imageDict=code_block_16.imageDict, scriptSettingsDict=code_block_16.scriptSettingsDict, amountAdaptivePoints=code_block_16.amountAdaptivePoints) { imageDict; scriptSettingsDict; amountAdaptivePoints; configFileMeta; }  # unwired: configFileMeta

# group: Creating adaptive components
# note: description
code_block_55 = CodeBlock(familyTypes=code_block_45.familyTypes, pointpairLists=code_block_45.positions) { familyTypes; pointpairLists; }
code_block_56 = CodeBlock(familyTypes=code_block_55.familyTypes, pointpairLists=code_block_55.pointpairLists) { familyTypes; pointpairLists; }
byPoints = AdaptiveComponent.ByPoints(points=code_block_56.pointpairLists, familyType=code_block_56.familyTypes, lacing=Longest)

# group: format data for inputs and creating inputs for user to enter parameters
# note: description
code_block_57 = CodeBlock(referenceImage=code_block_11.referenceImageObject, Logo=code_block_35.Logo, defaultParameterLists=code_block_53.defaultParameterList, selectedGroupNames=code_block_53.selectedItemNames) { referenceImage; Logo; defaultParameterLists; selectedGroupNames; }
code_block_58 = CodeBlock { "Continue"; 1000; 850; "Cancel"; }
string_20 = StringInput("Instructions:")
string_21 = StringInput("For the object types: enter the start index of de objects")
data_shapes_ui_textnote_data = Custom[Data-Shapes_UI.TextNote Data](Title=string_20, TextNote=string_21)  # package Data-Shapes; Create Data for TextNote input in UI.MultipleInputForm ++ . Check out www.data-shapes.net for more informations
code_block_59 = CodeBlock { "ROCO_CNU_OBS.Index_start"; "0.0000"; }
code_block_60 = CodeBlock(selectedObjects=code_block_57.selectedGroupNames, keys=code_block_59.out0, values=code_block_59.out1)
# ---------- code_block_60.designscript (8 lines) ----------
selectedObjects;
keys;
values;
count=List.Count(selectedObjects);
paramDict=Dictionary.ByKeysValues(keys, values);
parameterList= List.OfRepeatedItem(paramDict, count);
parameterList.Keys;
parameterList[parameterList.Keys];
# ----------------------------------------
ui_textbox_data_3 = Custom[UI.TextBox Data](InputName=code_block_60.out6, DefaultText=code_block_60.out7)
data_shapes_ui_inputgroup_data_4 = Custom[Data-Shapes_UI.InputGroup Data](GroupTitle=code_block_60.selectedObjects, Inputs=ui_textbox_data_3)
code_block_61 = CodeBlock(item1=data_shapes_ui_textnote_data, inList=data_shapes_ui_inputgroup_data_4, item2=code_block_57.referenceImage) { inlist1=List.AddItemToFront(item1, inList); b=List.AddItemToFront(item2,inlist1); c=List.Flatten(b); }
boolean_5 = BoolSelector(true)
passthrough = Custom[Passthrough](passThrough=boolean_5, waitFor=code_block_61.c)  # package Clockwork for Dynamo 2.x; Forces a sequential order of execution. The node wired into the output of the Passthrough node will be executed *after* the node wired into the waitFor input (e.g. important for some Revit operations). The value of the passThrough input will be passed on to the node wired into the output port of the Passthrough node.
code_block_62 = CodeBlock(logo=code_block_57.Logo, ButtonText=code_block_58.out0, inputs=code_block_61.c, objectHasData=passthrough, cancelButtonText=code_block_58.out3, maxHeight=code_block_58.out1, uiWidth=code_block_58.out2, ParameterValueHeaderLists=code_block_60.out6) { Descritpion; logo; ButtonText; inputs; objectHasData; cancelButtonText; maxHeight; uiWidth; ParameterValueHeaderLists; }  # unwired: Descritpion

# group: User enters parameter values for each object type
ui_multipleinputform = Custom[UI.MultipleInputForm ++](Description_optional=code_block_62.Descritpion, Logo_optional=code_block_62.logo, ButtonText_optional=code_block_62.ButtonText, Inputs=code_block_62.inputs, Toggle=code_block_62.objectHasData, CancelButtonText_optional=code_block_62.cancelButtonText, MaxHeight_optional=code_block_62.maxHeight, Width_optional=code_block_62.uiWidth)  # package Data-Shapes; Create a form with multiple inputs. see www.data-shapes.net for tutorials and infos!
code_block_63 = CodeBlock(inList1=ui_multipleinputform.User_Inputs) { List.Chop(inList1,1); }
watch = Watch(code_block_63)

# group: creating PE id for each object (ascending, incrementing by 1)
# note: description
code_block_64 = CodeBlock(adaptiveCompontents=byPoints, parameter_dict_keys=code_block_62.ParameterValueHeaderLists, parameter_dict_values=watch) { [adaptiveCompontents]; parameter_dict_keys; parameter_dict_values; firstPointsList; }  # unwired: firstPointsList
byKeysValues_2 = DesignScript.Builtin.Dictionary.ByKeysValues(keys=code_block_64.parameter_dict_keys, values=code_block_64.parameter_dict_values, lacing=Longest)
string_22 = StringInput("ROCO_CNU_OBS.Index_start")
valueAtKey_10 = DesignScript.Builtin.Dictionary.ValueAtKey(dictionary=byKeysValues_2, key=string_22)
toNumber_2 = String.ToNumber(str=valueAtKey_10)
code_block_65 = CodeBlock { "ROCO_CNU_OBS.Index"; }
create_id_dict_from_list = Python(IN[0]=code_block_64.out0, IN[1]=toNumber_2, IN[2]=code_block_65)  # "create ID dict from list adaptive components + start offset: Python Script"
# ---------- create_id_dict_from_list.python (41 lines) ----------
# Load the Python Standard and DesignScript Libraries
import sys
import clr
clr.AddReference('ProtoGeometry')
from Autodesk.DesignScript.Geometry import *

# The inputs to this node will be stored as a list in the IN variables.
firstPointsList, idStart, key = IN

templist = []
templist1 =[]
outlist = []
i = 0
j = 0

# Place your code below this line


while i < len(firstPointsList):
    firstPoints = firstPointsList[i]
    index = idStart[i]
    templist1.Clear()
    j = 0
    while j < len(firstPoints):
    	k = 0
    	templist.Clear()
        while k < len(firstPoints[j]):
            index_str = str(index)
            index_str = index_str.split(".")[0]
            index_str = index_str.split(",")[0]
            templist.append({key: int(index_str)})
            index += 1
            k += 1
        templist1.append(list(templist))
        j += 1
    outlist.append(list(templist1))
    i += 1


# Assign your output to the OUT variable.
OUT = outlist
# ----------------------------------------
code_block_66 = CodeBlock(PE_Id_dict=create_id_dict_from_list, adaptiveComponents=code_block_64.out0) { PE_Id_dict; adaptiveComponents; }

# group: creating parameter_value dict for all type objects, including the script info
# note: description
code_block_67 = CodeBlock(parameterDict=byKeysValues_2, removeStartIDValue=string_22, c3DInfoDict=code_block_53.scriptSettings, numberParams=code_block_53.numberParameterNames, configFileMeta=code_block_45.configfileMeta) { parameterDict; removeStartIDValue; c3DInfoDict; numberParams; configFileMeta; }
removeKeys = DesignScript.Builtin.Dictionary.RemoveKeys(dictionary=code_block_67.parameterDict, keys=code_block_67.removeStartIDValue)
code_block_68 = CodeBlock { ["ROCO_CTE_Dynamo.GUID","ROCO_CTE_Dynamo.Script"]; }
generateGuid = DynamoROCO.DesignLog.GenerateGuid()
string_23 = StringInput("ConfigFileMeta")
byKeysValues_3 = DesignScript.Builtin.Dictionary.ByKeysValues(keys=string_23, values=code_block_67.configFileMeta)
string_24 = StringInput("ScriptMeta")
script_CreateMeta = Custom[Script_CreateMeta]()  # package ROCO Dyf Packages; Creates script meta data to put onto object parameters
setValueAtKeys_2 = DesignScript.Builtin.Dictionary.SetValueAtKeys(dictionary=byKeysValues_3, keys=string_24, values=script_CreateMeta)
stringifyJSON = Data.StringifyJSON(values=setValueAtKeys_2, lacing=Longest)
list_create_2 = List.Create(item0=generateGuid, item1=stringifyJSON)
setValueAtKeys_3 = DesignScript.Builtin.Dictionary.SetValueAtKeys(dictionary=removeKeys, keys=code_block_68, values=list_create_2)
string_25 = StringInput("ROCO_CTE_Reference_Source_Data")
code_block_69 = CodeBlock(C3D_Reference_Dict=code_block_67.c3DInfoDict) { C3D_Reference_Dict; }
stringifyJSON_2 = Data.StringifyJSON(values=code_block_69, lacing=Longest)
setValueAtKeys_4 = DesignScript.Builtin.Dictionary.SetValueAtKeys(dictionary=setValueAtKeys_3, keys=string_25, values=stringifyJSON_2, lacing=Longest)
code_block_70 = CodeBlock(numberParams=code_block_67.numberParams) { numberParams; }
valueAtKey_11 = DesignScript.Builtin.Dictionary.ValueAtKey(dictionary=setValueAtKeys_3, key=code_block_70)
toNumber_3 = String.ToNumber(str=valueAtKey_11)
code_block_71 = CodeBlock(in_dict=setValueAtKeys_4, keys=code_block_70, values=toNumber_3) { in_dict; keys; values; }
create_parameter_dictionary = Python(IN[0]=code_block_71.in_dict, IN[1]=code_block_71.keys, IN[2]=code_block_71.values)  # "create parameter dictionary: Python Script"
# ---------- create_parameter_dictionary.python (30 lines) ----------
# Load the Python Standard and DesignScript Libraries
import sys
import clr
clr.AddReference('ProtoGeometry')
from Autodesk.DesignScript.Geometry import *

# The inputs to this node will be stored as a list in the IN variables.
in_list, add_keys, add_values =IN

tempdict ={}
outlist=[]
templist=[]
# Place your code below this line
i=0
while i< len(in_list):
	in_dict=in_list[i]
	keylist=add_keys[i]
	valuelist=add_values[i]
	j=0
	while j< len(keylist):
		in_dict[keylist[j]]=valuelist[j]	
		j+=1
	outlist.append(in_dict)
	i+=1

	
		
	
# Assign your output to the OUT variable.
OUT = outlist
# ----------------------------------------
code_block_72 = CodeBlock(parameterDict=create_parameter_dictionary) { parameterDict; }

# group: createBaselineStationDict
code_block_73 = CodeBlock(baselineStations=code_block_44.stations) { baselineStations; }
code_block_74 = CodeBlock { "ROCO_CNU_Station"; }
count_3 = List.Count(list=code_block_73, lacing=Longest)
ofRepeatedItem = List.OfRepeatedItem(item=code_block_74, amount=count_3)
createstationdict_from_baseline = Python(IN[0]=code_block_73, IN[1]=ofRepeatedItem)  # "createStationDict from baseline stations: Python Script"
# ---------- createstationdict_from_baseline.python (28 lines) ----------
# Load the Python Standard and DesignScript Libraries
import sys
import clr
clr.AddReference('ProtoGeometry')
from Autodesk.DesignScript.Geometry import *

# The inputs to this node will be stored as a list in the IN variables.
firstItemsList, keyList = IN

templist = []
templist1 = []
outlist = []
i = 0

while i < len(firstItemsList):
    firstPoints = firstItemsList[i]
    keys = keyList[i]
    templist1.Clear()
    j = 0
    while j < len(firstPoints):
        templist1.append({keys[j]: firstPoints[i]})
        j += 1
    outlist.append(list(templist1))
    i += 1


# Assign your output to the OUT variable.
OUT = outlist
# ----------------------------------------
code_block_75 = CodeBlock(stationDict=createstationdict_from_baseline) { stationDict; }

code_block_76 = CodeBlock { 1; }

# group: compiling parameter list and setting parameters on elements
# note: description
code_block_77 = CodeBlock(adaptiveComponents=code_block_66.adaptiveComponents, pe_id_dict=code_block_66.PE_Id_dict, defaultParameterList=code_block_72, stationsDict=code_block_75) { adaptiveComponents; pe_id_dict; defaultParameterList; stationsDict; objectRotationDict; }  # unwired: objectRotationDict
flatten_3 = List.Flatten(list=code_block_77.adaptiveComponents, amt=code_block_76)
flatten_4 = List.Flatten(list=code_block_77.pe_id_dict)
flatten_5 = List.Flatten(list=code_block_77.stationsDict)

flatten_6 = List.Flatten(list=flatten_3)
flatten_7 = List.Flatten(list=code_block_77.defaultParameterList)
count_4 = List.Count(list=flatten_3, lacing=Longest)
ofRepeatedItem_2 = List.OfRepeatedItem(item=flatten_7, amount=count_4, lacing=Longest)
flatten_8 = List.Flatten(list=ofRepeatedItem_2)
dictionaryupdate = Custom[dictionaryupdate](targetDict=flatten_4, addDict=flatten_5)  # package ROCO Dyf Packages; Updates dictionary with another dict
dictionaryupdate_2 = Custom[dictionaryupdate](targetDict=flatten_8, addDict=dictionaryupdate)
setParameters = Custom[Element.SetParameters](elementInstance=flatten_6, parameterDict=dictionaryupdate_2, lacing=Longest)  # package ROCO Dyf Packages; Sets parameters based on element and parameter dict

# group (continued): compiling parameter list and setting parameters on elements
parameters_set_0_watch = Watch(setParameters)  # graph output

code_block_78 = CodeBlock()
# ---------- code_block_78.designscript (1 lines) ----------
[["Family Type: W*T_7500*1200, Family: [Pr_20_93_71_18]_TBC Concrete diaphragm wall units_ROCO_(GMA2)" ,"1","alignmentProfile.dwg | COR - MWA1-Right-2.800 - (1) | Axis_Floor_Left" ],["Blanco","2","alignmentProfile.dwg | COR - MWA1-Right-2.800 - (1) | Axis_Outer_Wall_Left"],["Blanco","1","alignmentProfile.dwg | COR - MWA1-Right-2.800 - (1) | Axis_Outer_Wall_Left"]];
# ----------------------------------------
