# Dynamo custom node C3DMeta_Alignment.dyf (Dynamo 2.3.0.5885)
# category: DynamoROCODyfs.DataFunctions
# creates metadata from civil3D Alignment

# group: INPUT
civilDocumentName = Input(civilDocumentName: string = "N/A")
alignmentName = Input(alignmentName: string = "N/A")
startStation = Input(startStation: var[]..[] = null)
endStation = Input(endStation: var[]..[] = null)

# group: Creating reference info dict for objects
code_block = CodeBlock { ["docName","aliName","StartStation","EndStation"]; }
code_block_2 = CodeBlock(civilDocumentName=civilDocumentName, alignmentName=alignmentName, startStation=startStation, endStation=endStation) { civilDocumentName; alignmentName; startStation; endStation; }
list_create = List.Create(item0=code_block_2.civilDocumentName, item1=code_block_2.alignmentName, item2=code_block_2.startStation, item3=code_block_2.endStation)
flatten = List.Flatten(list=list_create)
# note: description
code_block_3 = CodeBlock { ["Source","Type","ObjectDOB"]; ["C3D","Corridor&Alignment"]; }
now = DateTime.Now()
string_from_object = FromObject(obj=now)
addItemToEnd = List.AddItemToEnd(item=string_from_object, list=code_block_3.out1)
byKeysValues = DesignScript.Builtin.Dictionary.ByKeysValues(keys=code_block_3.out0, values=addItemToEnd)
code_block_4 = CodeBlock(keys=code_block, values=flatten, main_dict=byKeysValues) { keys; values; main_dict; }
byKeysValues_2 = DesignScript.Builtin.Dictionary.ByKeysValues(keys=code_block, values=flatten)
code_block_5 = CodeBlock(c3dInfoDict=byKeysValues_2) { c3dInfoDict; }

# group: OUTPUT
C3DMetaDict = Output(code_block_5)
