# Dynamo custom node Element.SetParameters.dyf (Dynamo 2.3.0.5885)
# category: DynamoROCODyfs.DynamoROCO.Elements
# Sets parameters based on element and parameter dict

elementInstance = Input(elementInstance: Revit.Elements.Element)
parameterDict = Input(parameterDict: DesignScript.Builtin.Dictionary)
setparam_python_script = Python(IN[0]=elementInstance, IN[1]=parameterDict)
# ---------- setparam_python_script.python (54 lines) ----------
import clr
clr.AddReference('RevitAPI')
from Autodesk.Revit.DB import *
from Autodesk.Revit.DB.UnitUtils import *

clr.AddReference("RevitNodes")
import Revit
from Revit.Elements import *
clr.ImportExtensions(Revit.Elements)

clr.AddReference("RevitServices")
import RevitServices
from RevitServices.Persistence import DocumentManager

from RevitServices.Transactions import TransactionManager

doc = DocumentManager.Instance.CurrentDBDocument
TransactionManager.Instance.EnsureInTransaction(doc)



def setParamValue(param, value):
	unitType = param.Definition.UnitType
	doc = DocumentManager.Instance.CurrentDBDocument
	docDUT = doc.GetUnits().GetFormatOptions(unitType).DisplayUnits
	try: 
		value = ConvertToInternalUnits(value, docDUT)
	except:
		value = value
	param.Set(value)
		
succesDict = {}
errorDict = {}
outDict= {}

item = UnwrapElement(IN[0])
paramDict = IN[1]

for key in paramDict:
	try:
		unwrapItem = UnwrapElement(item)
		itemParam = unwrapItem.GetParameters(key)[0]
		setParamValue( itemParam, paramDict[key])
		succesDict["element"] = item		
		succesDict[key]= paramDict[key] 
		#succesDict[str("Type"+key)] = itemParam.Definition.UnitType
	except:
		errorDict[key]= paramDict[key]
		pass
outDict["succes"]= succesDict
outDict["failed"]= errorDict
TransactionManager.Instance.TransactionTaskDone()

OUT = outDict
# ----------------------------------------
