# Dynamo custom node SelectAlignmentByNameAndDrawing.dyf (Dynamo 1.3.4.6666)
# category: DynamoROCODyfs

loadRocoLogo = Custom[LoadRocoLogo]()
code_block = CodeBlock { "Select"; }
code_block_2 = CodeBlock { "Civil3D Alignments"; }
civilApplication = CivilConnection.CivilApplication.CivilApplication()
code_block_3 = CodeBlock(arg1=civilApplication)  # unwired: arg0
# ---------- code_block_3.designscript (50 lines) ----------
outDoc={};
outKeys={};
outData={};

hasData:bool;
hasData = false;

_app: CivilApplication;

[Imperative]
{
 if (_app==null)
 {
  outKeys[0]="None";
  outData[0]=null;
 } else {
  _docs = _app.GetDocuments();
  if (_docs==null) {
   outKeys[0]="None";
   outData[0]=null;
  } else {
   _docCount = Count(_docs);
   _docIndex=0;
   _outIndex=0;
   while (_docIndex<_docCount)
   {
    _doc: CivilDocument =  _docs[_docIndex];
    _alignments =_doc.GetAlignments();
    if (_alignments==null) {
     outKeys[0]="None";
     outData[0]=null;
    } else {
     _alCount=Count(_alignments);
     _alIndex=0;
     while(_alIndex<_alCount)
     {
      _al = _alignments[_alIndex];
      outKeys[_outIndex] =_doc.Name+" | "+_al.Name;
      outData[_outIndex] =_al;
      outDoc[_outIndex]=_doc;
      _alIndex=_alIndex+1;
      _outIndex=_outIndex+1;
     }
     _docIndex=_docIndex+1;
     hasData=true;
    }
   };
  }
 }
};
# ----------------------------------------
code_block_4 = CodeBlock { 0; }
ui_dropdown_data = Custom[UI.DropDown Data](InputName=code_block_2, Keys=code_block_3.out1, Values=code_block_3.out2, DefaultValueIndex=code_block_4)  # Create data for DropDown input in UI.MultiInputForm ++ . Check out www.data-shapes.net for more infos.
code_block_5 = CodeBlock { "Cancel"; }
length = String.Length(code_block_3.out1)
maximumItem = List.MaximumItem(length)
code_block_6 = CodeBlock(chars=maximumItem) { chars; width = Math.Max(350, Math.Round(200*chars/25)); }
ui_multipleinputform = Custom[UI.MultipleInputForm ++](Logo_optional=loadRocoLogo, ButtonText_optional=code_block, Inputs=ui_dropdown_data, Toggle=code_block_3.out3, CancelButtonText_optional=code_block_5, Width_optional=code_block_6.width)  # Create a form with multiple inputs. see www.data-shapes.net for tutorials and infos!
firstItem = List.FirstItem(ui_multipleinputform.User_Inputs)

# group: Input
proposedEndStation = Input()

endStationToUse = Custom[EndStationToUse](endStation=proposedEndStation, alignment=firstItem)  # Depending on the value of the end station input, selects the input value or the alignment length

# group: Output
alignment = Output(firstItem)
endstation = Output(endStationToUse)

code_block_7 = CodeBlock { null; }
eq = firstItem == code_block_7
not_ = Not(eq)
indexOf = IndexOf(code_block_3.out2, firstItem)
getItemAtIndex = List.GetItemAtIndex(list=code_block_3.out0, index=indexOf)
if_ = If(test=not_, true=getItemAtIndex, false=code_block_7)

# group: Output
civilDocument = Output(if_)
