# Dynamo custom node filterFamilyAndTypesFromConfig.dyf (Dynamo 2.3.0.5885)
# category: DynamoROCODyfs.DynamoROCO.Family
# filter revit family and types based on configuration dictionary
# packages: Clockwork for Dynamo 2.x 2.1.2

# group: INPUT
configDictionary = Input(configDictionary: DesignScript.Builtin.Dictionary)
key = Input(key: var[]..[])
code_block = CodeBlock(configDictionary=configDictionary, key=key) { configDictionary; key; }

# group: Filter families in project based on search query of config_file
code_block_2 = CodeBlock { "filters targetlist based on string: "; "'|' is used to define 'or'"; "',' is used to define 'and'"; }
# note: filter Family object items based on string
code_block_3 = CodeBlock(configDictionary=code_block.configDictionary, key=code_block.key) { configDictionary; key; }
designscriptbuiltin = DesignScript.Builtin.Dictionary.ValueAtKey(dictionary=code_block_3.configDictionary, key=code_block_3.key)
element_types = ElementTypes("Family")
all_elements_of_type = ElementsOfType(element_type=element_types)
name = Element.Name(element=all_elements_of_type)
boolean = BoolSelector(true)
code_block_4 = CodeBlock(filters=designscriptbuiltin, targetList=name, ignoreCase=boolean) { filters; targetList; ignoreCase; }
python_script = Python(IN[0]=code_block_4.filters, IN[1]=code_block_4.targetList, IN[2]=code_block_4.ignoreCase)
# ---------- python_script.python (76 lines) ----------
# Load the Python Standard and DesignScript Libraries
import sys
import clr
clr.AddReference('ProtoGeometry')
from Autodesk.DesignScript.Geometry import *
# functions

def unique(list0): 
    # insert the list to the set 
    list_set = set(list0) 
    # convert the set to the list 
    unique_list = (list(list_set)) 
    return unique_list
    
# The inputs to this node will be stored as a list in the IN variables.
filters=IN[0]
targetlist = IN[1]
ignorecase=IN[2]

outdict={}
tempdict={}
list1=[]
target_templist=[]
target_temp = list(targetlist)
target_outlist=[]
i=0
# Place your code below this line
for filtr in filters:
    if "str" in str(type(filtr)):
        list1.append(filtr.split(","))
    else:
        list1.append(["@/NSF/@"])
    i += 1

if ignorecase:  # setting all items to lower instead of capitalized, then reassinging them in the to edit list.
    j = 0
    for sublist in list1:
        k = 0
        for item in sublist:
            sublist[k] = item.lower()
            k += 1
        list1[j] = sublist
        j += 1
    j = 0
    for item in target_temp:
        target_temp[j] = item.lower()
        j += 1

outdict["filters"] = list1

for sublist in list1:                   #FOR SUBLIST IN LIST OF SEARCH QUERIES
    target_templist.Clear()             #CLEAR TEMP LIST OF TARGETS
    count0 = 0                          #SETTING REFERENCE VALUE 0
    for target in target_temp:          #FOR EACH SEARCH QUERY
        count1 = 0                      #COUNT MATCHES=O
        for item in sublist:            #FOR EACH SEARCH ITEM IN THE SEARCH QUERY
            if "|" in item:             # filter based on OR value
                item = item.split("|")  #split the match cases
                for i in item:          #if 1 of the matches is in the string, add 1 to the counter
                    if i in target:
                        count1 += 1
                        break
            elif "!=" in item[:2]:       #if search query contains "not" symbol
                if item[2:] in target:
                    count1 -= 1         #reduces count of checks
                else:
                	count1 += 1
            elif item in target:        #if target contains stringvalue
                count1 += 1
        if count1 == len(sublist):
            target_templist.append(targetlist[count0])
        count0 += 1
    target_outlist.append(unique(list(target_templist)))
outdict["match"] = target_outlist
# Assign your output to the OUT variable.
OUT = outdict
# ----------------------------------------
code_block_5 = CodeBlock { "match"; }
valueAtKey = DesignScript.Builtin.Dictionary.ValueAtKey(dictionary=python_script, key=code_block_5)

# group: creating input data for selecting families and type in UI
# note: description
byName = Family.ByName(name=valueAtKey)
types = Family.Types(family=byName)
python_script_2 = Python(IN[0]=types)
# ---------- python_script_2.python (21 lines) ----------
# Load the Python Standard and DesignScript Libraries
import sys
import clr
clr.AddReference('ProtoGeometry')
from Autodesk.DesignScript.Geometry import *

# The inputs to this node will be stored as a list in the IN variables.
inlist=IN[0]
templist=[]
outlist=[]
# Place your code below this line
for sublist in inlist:
	templist.Clear()
	for item in sublist:
		for i in item:
			templist.append(i)
	outlist.append(list(templist))
			
		
# Assign your output to the OUT variable.
OUT = outlist
# ----------------------------------------
isEmpty = List.IsEmpty(list=python_script_2, lacing=Longest)
code_block_6 = CodeBlock { ["N/A"]; }
code_block_7 = CodeBlock(targetlist=python_script_2, booleanList=isEmpty, itemToPlace=code_block_6) { targetlist; booleanList; itemToPlace; }
replaceitemsbybool_python_script = Python(IN[0]=code_block_7.targetlist, IN[1]=code_block_7.booleanList, IN[2]=code_block_7.itemToPlace)
# ---------- replaceitemsbybool_python_script.python (20 lines) ----------
# Load the Python Standard and DesignScript Libraries
import sys
import clr
clr.AddReference('ProtoGeometry')
from Autodesk.DesignScript.Geometry import *

# The inputs to this node will be stored as a list in the IN variables.
targetlist, booleanlist, replaceitem = IN
i=0
# Place your code below this line
try:
	while i< len(booleanlist):
		if booleanlist[i]:
			targetlist[i]=replaceitem
		i+=1
except:
	pass

# Assign your output to the OUT variable.
OUT = targetlist
# ----------------------------------------
name_2 = Family.Name(family=byName)
string = StringInput(" | Type: ")
operators = name_2 + string  # lacing=Longest
name_3 = FamilyType.Name(familyType=types)
operators_2 = operators + name_3
string_2 = StringInput("  | Category: ")
operators_3 = operators_2 + string_2  # lacing=Longest
getCategory = Element.GetCategory(element=types)
operators_4 = operators_3 + getCategory
python_script_3 = Python(IN[0]=operators_4)  # same code as python_script_2
isEmpty_2 = List.IsEmpty(list=python_script_3, lacing=Longest)
code_block_8 = CodeBlock { ["no family or type found"]; }
code_block_9 = CodeBlock(targetlist=python_script_3, booleanList=isEmpty_2, itemToPlace=code_block_8) { targetlist; booleanList; itemToPlace; }
replaceitemsbybool_python_script_2 = Python(IN[0]=code_block_9.targetlist, IN[1]=code_block_9.booleanList, IN[2]=code_block_9.itemToPlace)  # same code as replaceitemsbybool_python_script
code_block_10 = CodeBlock(familyTypes=replaceitemsbybool_python_script, inputFamilyTypeString=replaceitemsbybool_python_script_2) { familyTypes; inputFamilyTypeString; }

# group: Output
code_block_11 = CodeBlock(configDictionary=code_block.configDictionary, familyTypes=code_block_10.familyTypes, inputFamilyTypeString=code_block_10.inputFamilyTypeString) { configDictionary; familyTypes; inputFamilyTypeString; }
passthrough = Custom[Passthrough](passThrough=code_block_11.configDictionary, waitFor=code_block_11.familyTypes)  # package Clockwork for Dynamo 2.x; Forces a sequential order of execution. The node wired into the output of the Passthrough node will be executed *after* the node wired into the waitFor input (e.g. important for some Revit operations). The value of the passThrough input will be passed on to the node wired into the output port of the Passthrough node.
configDictionary_2 = Output(passthrough)  # "configDictionary"
familyTypes = Output(code_block_11.familyTypes)
inputFamilyTypeString = Output(code_block_11.inputFamilyTypeString)
