# Dynamo custom node imageObjectsFromConfig.dyf (Dynamo 2.3.0.5885)
# category: DynamoROCODyfs.DynamoROCO.UIObjects
# Create ui objects from configuration file
# packages: Data-Shapes 2019.2.40

# group: Input
jsonData = Input(jsonData: var[]..[])
code_block = CodeBlock(JSONImportPictureData=jsonData) { JSONImportPictureData; }

# group: Creating image data for use in script
# note: Converting the imported json into 2 filepath, 1 for the logo in the UI, the other as reference image in the UI
code_block_2 = CodeBlock(JSONImportPictureData=code_block) { JSONImportPictureData; }
code_block_3 = CodeBlock { "Logo"; "ReferenceImage"; }
valueAtKey = DesignScript.Builtin.Dictionary.ValueAtKey(dictionary=code_block_2, key=code_block_3.out0)
fromPath = FileObject(path=valueAtKey)  # "File.FromPath"
readFromFile = Image.ReadFromFile(file=fromPath)
code_block_4 = CodeBlock(Logo=readFromFile) { Logo; }
string = StringInput("Reference image")
valueAtKey_2 = DesignScript.Builtin.Dictionary.ValueAtKey(dictionary=code_block_2, key=code_block_3.out1)
fromPath_2 = FileObject(path=valueAtKey_2)  # "File.FromPath"
string_from_object = FromObject(obj=fromPath_2)
filepath_from_string_python = Python(IN[0]=string_from_object)  # "filepath from string:python script"
# ---------- filepath_from_string_python.python (14 lines) ----------
# Load the Python Standard and DesignScript Libraries
import sys
import clr
import os
clr.AddReference('ProtoGeometry')
from Autodesk.DesignScript.Geometry import *

# The inputs to this node will be stored as a list in the IN variables.


# Place your code below this line

# Assign your outputto the OUT variable.
OUT = os.path.join(IN[0])
# ----------------------------------------
boolean = BoolSelector(false)
data_shapes_ui_image_data = Custom[Data-Shapes_UI.Image Data](Image=filepath_from_string_python, ShowBorder_optional=boolean)  # package Data-Shapes; Places an image on UI.MultipleInutForm ++ .
data_shapes_ui_inputgroup_data = Custom[Data-Shapes_UI.InputGroup Data](GroupTitle=string, Inputs=data_shapes_ui_image_data)  # package Data-Shapes; Creates a group of inputs for UI.MultipleInputForm ++ . Check out www.data-shapes.net for more infos !
code_block_5 = CodeBlock(LogoImage=code_block_4, referenceImageObject=data_shapes_ui_inputgroup_data) { LogoImage; referenceImageObject; }

# group: Output
code_block_6 = CodeBlock(LogoImage=code_block_5.LogoImage, referenceImageObject=code_block_5.referenceImageObject) { LogoImage; referenceImageObject; }
LogoUIObject = Output(code_block_6.LogoImage)
ReferenceImageUIObject = Output(code_block_6.referenceImageObject)
